# Grasshopper definition arabia_a.gh (Grasshopper 0.9.76)
# plug-ins: Python Interpreter

座面飾り波形深さ = Slider(1, range=1..3, expression="x*10")
座面飾り高さ = Slider(3, range=1..3, expression="x*100")
number_slider = Slider(10, range=6..10, expression="x*0.1")
基本奥行 = Slider(2, range=2..3, expression="x*200")
座面高さ = Slider(4, range=4..5, expression="x*100")
波数 = Slider(3, range=3..7)
基本幅 = Slider(4, range=4..8, expression="x*100")
rectangle = Rectangle(Plane=PlaneXY(0, 0, 0), XSize=基本幅, YSize=基本奥行, Radius=0)  # -> Rectangle, Length
pi = Pi(Factor=波数)
dom = ConstructDomain(DomainStart=0, DomainEnd=pi)
debrep = DeconstructBrep(Brep=rectangle.Rectangle)  # -> Faces, Edges, Vertices
subtraction = Subtraction(A=座面高さ, B=座面飾り高さ)
rec = Rectangle({Plane=PlaneXY(-10, -10, 0), Size=Domain2(u=0..20, v=0..20)})
pt = Point(debrep.Vertices)
range = Range(Domain=dom, Steps="30")
Z = UnitZ(Factor=座面高さ)
orient = Orient(Geometry=rec, Source=PlaneXY(0, 0, 0), Target=pt)  # -> Geometry, Transform
Z_2 = UnitZ(Factor=座面高さ)
t = Expression(A=座面飾り波形深さ, t=range, Expression="A*sin(t)")
divide = DivideCurve(Curve=debrep.Edges, Count="30", Kinks=False)  # -> Points, Tangents, Parameters
move = Move(Geometry=debrep.Edges, Motion=Z)  # -> graft(Geometry), Transform
pdecon = Deconstruct(Point=divide.Points)  # -> XComponent, YComponent, ZComponent
extr = Extrude(Base=orient.Geometry, Direction=Z_2)
item = ListItem(List=debrep.Faces, Index=0, Wrap=True)
Z_3 = UnitZ(Factor=座面高さ)
pt_2 = ConstructPoint(XCoordinate=pdecon.XComponent, YCoordinate=pdecon.YComponent, ZCoordinate=t)
move_2 = Move(Geometry=item, Motion=Z_3)  # -> Geometry, Transform
Z_4 = UnitZ(Factor="20")
graft = GraftTree(Tree=move.Geometry, IncludeEmptyLists=True, IncludeNullItems=True)
Z_5 = UnitZ(Factor=subtraction)
intcrv = Interpolate(Vertices=pt_2, Degree=3, Periodic=False, KnotStyle=1)  # -> Curve, Length, Domain
extr_2 = Extrude(Base=move_2.Geometry, Direction=Z_4)
debrep_2 = DeconstructBrep(Brep=move_2.Geometry)  # -> Faces, Edges, Vertices
move_3 = Move(Geometry=intcrv.Curve, Motion=Z_5)  # -> Geometry, Transform
cap = CapHoles(Brep=extr)
item_2 = ListItem(List=debrep_2.Edges, Index=0, Wrap=True)  # -> Item, Item1, Item2, Item3
item_3 = ListItem(List=debrep_2.Vertices, Index=0, Wrap=True)  # -> Item, Item1, Item2, Item3
rulesrf = RuledSurface(CurveA=graft, CurveB=move_3.Geometry)
pt_3 = Point(item_3.Item1)
pt_4 = Point(item_3.Item2)
sunion = SolidUnion(Breps=rulesrf)
ln = Line(StartPoint=pt_3, EndPoint=pt_4)
offset = Offset(Surface=sunion, Distance="-10", Retrim=True)
mid = TK_MidPoint(C=ln)  # -> P
# ---------- mid: Python ----------
import rhinoscriptsyntax as rs

if C!=None:
    P=rs.CurveMidPoint(C)
else:
    P=None
# ---------- end mid ----------
loft = Loft(
    Curves=[rulesrf, offset],
    Options={Adjust=False, Closed=False, LoftEnds=0, LoftSimp=0, LoftType=0, Rebuild=10, Refit=0.01})
line = Line(item_2.Item1)
line_2 = Line(item_2.Item3)
subtraction_2 = Subtraction(A=1, B=number_slider)
join = BrepJoin(Breps=[rulesrf, offset, loft])  # -> flatten(Breps), Closed
end = EndPoints(Curve=line)  # -> Start, End
eval = EvaluateCurve(Curve=line, Parameter=number_slider)  # -> Point, Tangent, Angle
eval_2 = EvaluateCurve(Curve=line_2, Parameter=subtraction_2)  # -> Point, Tangent, Angle
pt_5 = Point(end.Start)
pt_6 = Point(eval.Point)
orient_2 = Orient(Geometry=rec, Source=PlaneXY(0, 0, 0), Target=[pt_3, mid, pt_4])  # -> Geometry, Transform
Z_6 = UnitZ(Factor=座面高さ)
Z_7 = UnitZ(Factor=1)
trim = TrimSolid(Shape=join.Breps, Cutters=cap)
ln_2 = Line(StartPoint=pt_5, EndPoint=pt_6)
line_3 = LineSDL(Start=[eval.Point, eval_2.Point], Direction=Z_7, Length=Slider(3, range=1..3, expression="x*50"))
len = Length(Curve=ln_2)
extr_3 = Extrude(Base=orient_2.Geometry, Direction=Z_6)
end_2 = EndPoints(Curve=line_3)  # -> Start, End
cap_2 = CapHoles(Brep=extr_3)
Y = UnitY(Factor=1)
pt_7 = Point(end_2.End)
item_4 = ListItem(List=cap_2, Index=0, Wrap=True)  # -> Item, Item1, Item2
line_4 = LineSDL(Start=pt_7, Direction=Y, Length=len)
brep = Brep(item_4.Item)
brep_2 = Brep(item_4.Item2)
pipe = Pipe(Curve=[line_4, line_3], Radius="10", Caps=2)
debrep_3 = DeconstructBrep(Brep=brep)  # -> Faces, Edges, Vertices
debrep_4 = DeconstructBrep(Brep=brep_2)  # -> Faces, Edges, Vertices
item_5 = ListItem(List=debrep_3.Vertices, Index="7", Wrap=True)
item_6 = ListItem(List=debrep_4.Vertices, Index="6", Wrap=True)
ln_3 = Line(StartPoint=item_5, EndPoint=item_6)
xz = XZPlane(Origin=item_5)
len_2 = Length(Curve=ln_3)
rectangle_2 = Rectangle(Plane=xz, XSize=len_2, YSize="-150", Radius=0)  # -> Rectangle, Length
Y_2 = UnitY(Factor=expr("x*-1", "10"))
boundary = BoundarySurfaces(Edges=rectangle_2.Rectangle)
extr_4 = Extrude(Base=boundary, Direction=Y_2)
debrep_5 = DeconstructBrep(Brep=extr_4)  # -> Faces, Edges, Vertices
item_7 = ListItem(List=debrep_5.Faces, Index="5", Wrap=True)
faceb = FaceBoundaries(Mesh=item_7)
offset_2 = Offset(Curve=faceb, Distance="-15", Plane=PlaneXY(0, 0, 0), Corners=1)
Y_3 = UnitY(Factor=expr("x*-1", "10"))
boundary_2 = BoundarySurfaces(Edges=offset_2)
extr_5 = Extrude(Base=boundary_2, Direction=Y_3)
c_script = CSharpScript(folder="C:\ParametricImages\", makeimages=Button())  # -> out, A; inputs folder: String, makeimages: Boolean
# ---------- c_script: C# ----------
    if (!makeimages)
      return;

    if (_running)
      return;

    if (!System.IO.Directory.Exists(folder))
      System.IO.Directory.CreateDirectory(folder);

    _folder = folder;
    _run = true;
    GrasshopperDocument.SolutionEnd += OnSolutionEnd;
# ---------- c_script: C# additional code ----------
  private bool _run = false;
  private bool _running = false;
  private string _folder;

  private void OnSolutionEnd(object sender, GH_SolutionEventArgs e)
  {
    // Unregister the event, we don't want to get called again.
    e.Document.SolutionEnd -= OnSolutionEnd;

    // If we're not supposed to run, abort now.
    if (!_run)
      return;

    // If we're already running, abort now.
    if (_running)
      return;

    // Reset run and running states.
    _run = false;
    _running = true;

    try
    {
      // Find all sliders.
      List<Grasshopper.Kernel.Special.GH_NumberSlider> sliders = new List<Grasshopper.Kernel.Special.GH_NumberSlider>();
      foreach (IGH_DocumentObject docObject in GrasshopperDocument.Objects)
      {
        Grasshopper.Kernel.Special.GH_NumberSlider slider = docObject as Grasshopper.Kernel.Special.GH_NumberSlider;
        if (slider == null)
          continue;
        sliders.Add(slider);
      }
      if (sliders.Count == 0)
      {
        System.Windows.Forms.MessageBox.Show("No sliders could be found", "<harsh buzzing sound>", MessageBoxButtons.OK);
        return;
      }

      // Set all sliders back to zero.
      //GH_Document.EnableSolutions = false;
      foreach (Grasshopper.Kernel.Special.GH_NumberSlider slider in sliders)
        slider.TickValue = 0;

      // Start a giant loop in which we'll permutate our way across all slider layouts.
      int imageNumber = 0;
      while (true)
      {
        int idx = 0;
        if (!MoveToNextPermutation(ref idx, sliders))
          break;

        // We've just got a new valid permutation. Solve the new solution.
        e.Document.NewSolution(false);
        Rhino.RhinoDoc.ActiveDoc.Views.Redraw();

        Rhino.Display.RhinoView view = RhinoDocument.Views.Find("Perspective", false);
        if (view == null)
          break;

        string fileName = string.Format("{0}\\{1}.png", _folder, imageNumber);
        imageNumber++;

        Bitmap image = view.CaptureToBitmap();
        if (image == null)
          continue;

        image.Save(fileName);
        image.Dispose();
        image = null;
      }
    }
    catch(Exception ex)
    {
      // Ehm, exception, best swallow it here lest it totally crashes everything.
    }
    finally
    {
      // Always make sure that _running is switched off.
      _running = false;
    }
  }

  private bool MoveToNextPermutation(ref int index, List<Grasshopper.Kernel.Special.GH_NumberSlider> sliders)
  {
    if (index >= sliders.Count)
      return false;

    Grasshopper.Kernel.Special.GH_NumberSlider slider = sliders[index];
    if (slider.TickValue < slider.TickCount)
    {
      // Increment the slider.
      slider.TickValue++;
      return true;
    }
    else
    {
      // The current slider is already at the maximum value. Reset it back to zero.
      slider.TickValue = 0;

      // Move on to the next slider.
      index++;

      // If we've run out of sliders to modify, we're done permutatin'
      if (index >= sliders.Count)
        return false;

      return MoveToNextPermutation(ref index, sliders);
    }
  }
# ---------- end c_script ----------
brep_3 = Brep(pipe)
brep_4 = Brep(extr_2)
brep_5 = Brep(extr_4)
brep_6 = Brep(extr_5)
brep_7 = Brep(trim)
brep_8 = Brep(cap)
brep_9 = Brep(cap_2)
merge = Merge(Data1=brep_7, Data2=brep_8, Data3=brep_3, Data4=brep_4, Data5=brep_5, Data6=brep_6, Data7=brep_9)
