# Grasshopper definition arabia_b.gh (Grasshopper 0.9.76)
# plug-ins: Python Interpreter

基本幅 = Slider(6, range=4..6, expression="x*100")
基本幅_2 = Slider(3, range=0..4, expression="x*50")
基本幅_3 = Slider(0, range=-2..0, expression="x*50")
基本幅_4 = Slider(5, range=4..8, expression="x*100")
基本幅_5 = Slider(7, range=4..8, expression="x*100")
addition = Addition(A=基本幅_2, B=-50)
addition_2 = Addition(A=基本幅_3, B=-50)
pt = ConstructPoint(XCoordinate=基本幅_2, YCoordinate=0, ZCoordinate="200")
pt_2 = ConstructPoint(XCoordinate=基本幅_3, YCoordinate=0, ZCoordinate="400")
pt_3 = ConstructPoint(XCoordinate=addition, YCoordinate=0, ZCoordinate="200")
pt_4 = ConstructPoint(XCoordinate=addition_2, YCoordinate=0, ZCoordinate="400")
pt_5 = Point(Point(0, 0, 0))
pt_6 = Point(pt)
pt_7 = Point(pt_2)
pt_8 = Point(Point(0, 0, 600))
pt_9 = Point(Point(-20, 0, 0))
pt_10 = Point(pt_3)
pt_11 = Point(pt_4)
pt_12 = Point(Point(-62, 0, 600))
X = UnitX(Factor=1)
line = LineSDL(Start=pt_5, Direction=X, Length=基本幅)
intcrv = Interpolate(Vertices=[pt_9, pt_10, pt_11, pt_12], Degree=3, Periodic=False, KnotStyle=1)  # -> Curve, Length, Domain
intcrv_2 = Interpolate(Vertices=[pt_5, pt_6, pt_7, pt_8], Degree=3, Periodic=False, KnotStyle=1)  # -> Curve, Length, Domain
mid = TK_MidPoint(C=line)  # -> P
# ---------- mid: Python ----------
import rhinoscriptsyntax as rs

if C!=None:
    P=rs.CurveMidPoint(C)
else:
    P=None
# ---------- end mid ----------
crv_cp = CurveClosestPoint(Point=pt_12, Curve=intcrv_2.Curve)  # -> Point, Parameter, Distance
xz = XZPlane(Origin=pt_12)
yz = YZPlane(Origin=mid)
intcrv_3 = Interpolate(Vertices=[pt_5, pt_6, pt_7, crv_cp.Point], Degree=3, Periodic=False, KnotStyle=1)  # -> Curve, Length, Domain
ln = Line(StartPoint=pt_12, EndPoint=crv_cp.Point)
len = Length(Curve=ln)
cir = Circle(Plane=xz, Radius=len)
loft = Loft(
    Curves=[intcrv_3.Curve, intcrv.Curve],
    Options={Adjust=False, Closed=False, LoftEnds=0, LoftSimp=0, LoftType=0, Rebuild=10, Refit=0.01})
circle = Circle(cir)
boundary = BoundarySurfaces(Edges=circle)
rdiff = RegionDifference(CurvesA=loft, CurvesB=boundary)
boundary_2 = BoundarySurfaces(Edges=rdiff)
join = BrepJoin(Breps=[boundary_2, boundary])  # -> Breps, Closed
debrep = DeconstructBrep(Brep=boundary_2)  # -> Faces, Edges, Vertices
Y = UnitY(Factor=基本幅_5)
item = ListItem(List=debrep.Edges, Index="5", Wrap=True)
mirror = Mirror(Geometry=join.Breps, Plane=yz)  # -> Geometry, Transform
mirror_2 = Mirror(Geometry=item, Plane=yz)  # -> Geometry, Transform
loft_2 = Loft(
    Curves=[item, mirror_2.Geometry],
    Options={Adjust=False, Closed=False, LoftEnds=0, LoftSimp=0, LoftType=0, Rebuild=10, Refit=0.01})
brep = Brep(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)
brep_2 = Brep(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)
split = SplitBrep(Brep=loft_2, Cutter=graft(brep))
item_2 = ListItem(List=split, Index=0, Wrap=True)
split_2 = SplitBrep(Brep=item_2, Cutter=graft(brep_2))
item_3 = ListItem(List=split_2, Index=0, Wrap=True)  # -> Item, Item1
srf = Surface(item_3.Item)
srf_2 = Surface(item_3.Item1)
Y_2 = UnitY(Factor="100")
subtraction = Subtraction(A=基本幅_5, B="100")
extr = Extrude(Base=srf, Direction=Y_2)
Y_3 = UnitY(Factor=subtraction)
debrep_2 = DeconstructBrep(Brep=extr)  # -> Faces, Edges, Vertices
item_4 = ListItem(List=debrep_2.Faces, Index=1, Wrap=True)
Z = UnitZ(Factor=基本幅_4)
extr_2 = Extrude(Base=[item_4, extr], Direction=Z)
move = Move(Geometry=extr_2, Motion=Y_3)  # -> Geometry, Transform
extr_3 = Extrude(Base=[join.Breps, mirror.Geometry, srf_2, move.Geometry], Direction=Y)
c_script = CSharpScript(folder="C:\ParametricImages\", makeimages=Button())  # -> out, A; inputs folder: String, makeimages: Boolean
# ---------- c_script: C# ----------
    if (!makeimages)
      return;

    if (_running)
      return;

    if (!System.IO.Directory.Exists(folder))
      System.IO.Directory.CreateDirectory(folder);

    _folder = folder;
    _run = true;
    GrasshopperDocument.SolutionEnd += OnSolutionEnd;
# ---------- c_script: C# additional code ----------
  private bool _run = false;
  private bool _running = false;
  private string _folder;

  private void OnSolutionEnd(object sender, GH_SolutionEventArgs e)
  {
    // Unregister the event, we don't want to get called again.
    e.Document.SolutionEnd -= OnSolutionEnd;

    // If we're not supposed to run, abort now.
    if (!_run)
      return;

    // If we're already running, abort now.
    if (_running)
      return;

    // Reset run and running states.
    _run = false;
    _running = true;

    try
    {
      // Find all sliders.
      List<Grasshopper.Kernel.Special.GH_NumberSlider> sliders = new List<Grasshopper.Kernel.Special.GH_NumberSlider>();
      foreach (IGH_DocumentObject docObject in GrasshopperDocument.Objects)
      {
        Grasshopper.Kernel.Special.GH_NumberSlider slider = docObject as Grasshopper.Kernel.Special.GH_NumberSlider;
        if (slider == null)
          continue;
        sliders.Add(slider);
      }
      if (sliders.Count == 0)
      {
        System.Windows.Forms.MessageBox.Show("No sliders could be found", "<harsh buzzing sound>", MessageBoxButtons.OK);
        return;
      }

      // Set all sliders back to zero.
      //GH_Document.EnableSolutions = false;
      foreach (Grasshopper.Kernel.Special.GH_NumberSlider slider in sliders)
        slider.TickValue = 0;

      // Start a giant loop in which we'll permutate our way across all slider layouts.
      int imageNumber = 0;
      while (true)
      {
        int idx = 0;
        if (!MoveToNextPermutation(ref idx, sliders))
          break;

        // We've just got a new valid permutation. Solve the new solution.
        e.Document.NewSolution(false);
        Rhino.RhinoDoc.ActiveDoc.Views.Redraw();

        Rhino.Display.RhinoView view = RhinoDocument.Views.Find("Perspective", false);
        if (view == null)
          break;

        string fileName = string.Format("{0}\\{1}.png", _folder, imageNumber);
        imageNumber++;

        Bitmap image = view.CaptureToBitmap();
        if (image == null)
          continue;

        image.Save(fileName);
        image.Dispose();
        image = null;
      }
    }
    catch(Exception ex)
    {
      // Ehm, exception, best swallow it here lest it totally crashes everything.
    }
    finally
    {
      // Always make sure that _running is switched off.
      _running = false;
    }
  }

  private bool MoveToNextPermutation(ref int index, List<Grasshopper.Kernel.Special.GH_NumberSlider> sliders)
  {
    if (index >= sliders.Count)
      return false;

    Grasshopper.Kernel.Special.GH_NumberSlider slider = sliders[index];
    if (slider.TickValue < slider.TickCount)
    {
      // Increment the slider.
      slider.TickValue++;
      return true;
    }
    else
    {
      // The current slider is already at the maximum value. Reset it back to zero.
      slider.TickValue = 0;

      // Move on to the next slider.
      index++;

      // If we've run out of sliders to modify, we're done permutatin'
      if (index >= sliders.Count)
        return false;

      return MoveToNextPermutation(ref index, sliders);
    }
  }
# ---------- end c_script ----------
