# Grasshopper definition arabia_c.gh (Grasshopper 0.9.76)
# plug-ins: GH_CPython

基本幅_奥 = Slider(0, range=0..2, expression="x*50")
背もたれ反り = Slider(1, range=0..1, expression="x*100")
背もたれ本数 = Slider(5, range=2..5)
脚径 = Slider(3, range=1..3, expression="x*10")
背もたれ高 = Slider(4, range=4..6, expression="x*100")
背もたれ高_2 = Slider(2, range=1..3, expression="x*100")
座面高さ = Slider(5, range=4..5, expression="x*100")
基本幅 = Slider(2, range=2..5, expression="x*200")
division = Division(A=脚径, B=-2)
vec = VectorXYZ(XComponent=division, YComponent=division, ZComponent=0)  # -> Vector, Length
rectangle = Rectangle(Plane=vec.Vector, XSize=脚径, YSize=脚径, Radius=0)  # -> Rectangle, Length
subtraction = Subtraction(A=基本幅, B=基本幅_奥)
pt = ConstructPoint(XCoordinate=基本幅, YCoordinate=0, ZCoordinate=0)
pt_2 = ConstructPoint(XCoordinate=基本幅_奥, YCoordinate="400", ZCoordinate=0)
pt_3 = ConstructPoint(XCoordinate=subtraction, YCoordinate="400", ZCoordinate=0)
pt_4 = Point("0,0,0")
Z = UnitZ(Factor=1)
pt_5 = Point([pt_2, pt_3])
line = LineSDL(Start=[pt_4, pt, pt_2, pt_3], Direction=Z, Length=座面高さ)
end = EndPoints(Curve=line)  # -> Start, End
devec = DeconstructVector(Vector=pt_5)  # -> XComponent, YComponent, ZComponent
devec_2 = DeconstructVector(Vector=pt_5)  # -> XComponent, YComponent, ZComponent
pt_6 = Point(end.End)
addition = Addition(A=座面高さ, B=背もたれ高)
addition_2 = Addition(A=devec_2.YComponent, B=背もたれ反り)
item = ListItem(List=pt_6, Index=0, Wrap=True)  # -> Item, Item1, Item2, Item3
pline = PolyLine(Vertices=[item.Item, item.Item1, item.Item3, item.Item2], Closed=True)
vec_2 = VectorXYZ(XComponent=devec.XComponent, YComponent=devec.YComponent, ZComponent=座面高さ)  # -> Vector, Length
vec_3 = VectorXYZ(XComponent=devec_2.XComponent, YComponent=addition_2, ZComponent=addition)  # -> Vector, Length
offset = Offset(Curve=pline, Distance=脚径, Plane=PlaneXY(0, 0, 0), Corners=1)
pt_7 = Point(vec_2.Vector)
pt_8 = Point(vec_3.Vector)
Z_2 = UnitZ(Factor=脚径)
boundary = BoundarySurfaces(Edges=offset)
ln = Line(StartPoint=pt_7, EndPoint=pt_8)
end_2 = EndPoints(Curve=ln)  # -> Start, End
eval = EvaluateCurve(Curve=ln, Parameter="0")  # -> Point, Tangent, Angle
pt_9 = Point(end_2.End)
pframe = PerpFrame(Curve=ln, Parameter="1")
item_2 = ListItem(List=pt_9, Index=0, Wrap=True)  # -> Item, Item1
deplane = DeconstructPlane(Plane=pframe)  # -> Origin, XAxis, YAxis, ZAxis
pl = ConstructPlane(Origin=item_2.Item, XAxis=deplane.YAxis, YAxis=eval.Tangent)
ln_2 = Line(StartPoint=item_2.Item, EndPoint=item_2.Item1)
ext = ExtendCurve(Curve=ln_2, Type=0, Start=脚径, End=脚径)
orient = Orient(Geometry=rectangle.Rectangle, Source=PlaneXY(0, 0, 0), Target=pl)  # -> Geometry, Transform
end_3 = EndPoints(Curve=ext)  # -> Start, End
multiplication = Multiplication(A=脚径, B=0.5)
unit = UnitVector(Vector=eval.Tangent)
extrude = ExtrudeLinear(Profile=orient.Geometry, OrientationP=item_2.Item, Axis=ext, OrientationA=end_3.Start)
cap = CapHoles(Brep=extrude)
amp = Amplitude(Vector=unit, Amplitude=multiplication)
division_2 = Division(A=脚径, B=-4)
geo = Geometry(rectangle.Rectangle)
offset_2 = Offset(Curve=geo, Distance=division_2, Plane=PlaneXY(0, 0, 0), Corners=1)
extrude_2 = ExtrudeLinear(Profile=rectangle.Rectangle, OrientationP=PlaneXY(0, 0, 0), Axis=ln)
extrude_3 = ExtrudeLinear(Profile=rectangle.Rectangle, OrientationP=PlaneXY(0, 0, 0), Axis=line)
move = Move(Geometry=cap, Motion=amp)  # -> Geometry, Transform
extr = Extrude(Base=boundary, Direction=Z_2)
item_3 = ListItem(List=extrude_2, Index=0, Wrap=True)  # -> Item, Item1
debrep = DeconstructBrep(Brep=extr)  # -> Faces, Edges, Vertices
debrep_2 = DeconstructBrep(Brep=item_3.Item)  # -> Faces, Edges, Vertices
debrep_3 = DeconstructBrep(Brep=item_3.Item1)  # -> Faces, Edges, Vertices
item_4 = ListItem(List=debrep.Faces, Index="6", Wrap=True)
item_5 = ListItem(List=debrep_2.Faces, Index=4, Wrap=True)
item_6 = ListItem(List=debrep_3.Faces, Index=2, Wrap=True)
split = SplitBrep(Brep=extrude_2, Cutter=item_4)
item_7 = ListItem(List=split, Index=0, Wrap=True)  # -> flatten(Item)
c_script = CSharpScript(folder="C:\ParametricImages\", makeimages=Button())  # -> out, A; inputs folder: String, makeimages: Boolean
# ---------- c_script: C# ----------
    if (!makeimages)
      return;

    if (_running)
      return;

    if (!System.IO.Directory.Exists(folder))
      System.IO.Directory.CreateDirectory(folder);

    _folder = folder;
    _run = true;
    GrasshopperDocument.SolutionEnd += OnSolutionEnd;
# ---------- c_script: C# additional code ----------
  private bool _run = false;
  private bool _running = false;
  private string _folder;

  private void OnSolutionEnd(object sender, GH_SolutionEventArgs e)
  {
    // Unregister the event, we don't want to get called again.
    e.Document.SolutionEnd -= OnSolutionEnd;

    // If we're not supposed to run, abort now.
    if (!_run)
      return;

    // If we're already running, abort now.
    if (_running)
      return;

    // Reset run and running states.
    _run = false;
    _running = true;

    try
    {
      // Find all sliders.
      List<Grasshopper.Kernel.Special.GH_NumberSlider> sliders = new List<Grasshopper.Kernel.Special.GH_NumberSlider>();
      foreach (IGH_DocumentObject docObject in GrasshopperDocument.Objects)
      {
        Grasshopper.Kernel.Special.GH_NumberSlider slider = docObject as Grasshopper.Kernel.Special.GH_NumberSlider;
        if (slider == null)
          continue;
        sliders.Add(slider);
      }
      if (sliders.Count == 0)
      {
        System.Windows.Forms.MessageBox.Show("No sliders could be found", "<harsh buzzing sound>", MessageBoxButtons.OK);
        return;
      }

      // Set all sliders back to zero.
      //GH_Document.EnableSolutions = false;
      foreach (Grasshopper.Kernel.Special.GH_NumberSlider slider in sliders)
        slider.TickValue = 0;

      // Start a giant loop in which we'll permutate our way across all slider layouts.
      int imageNumber = 0;
      while (true)
      {
        int idx = 0;
        if (!MoveToNextPermutation(ref idx, sliders))
          break;

        // We've just got a new valid permutation. Solve the new solution.
        e.Document.NewSolution(false);
        Rhino.RhinoDoc.ActiveDoc.Views.Redraw();

        Rhino.Display.RhinoView view = RhinoDocument.Views.Find("Perspective", false);
        if (view == null)
          break;

        string fileName = string.Format("{0}\\{1}.png", _folder, imageNumber);
        imageNumber++;

        Bitmap image = view.CaptureToBitmap();
        if (image == null)
          continue;

        image.Save(fileName);
        image.Dispose();
        image = null;
      }
    }
    catch(Exception ex)
    {
      // Ehm, exception, best swallow it here lest it totally crashes everything.
    }
    finally
    {
      // Always make sure that _running is switched off.
      _running = false;
    }
  }

  private bool MoveToNextPermutation(ref int index, List<Grasshopper.Kernel.Special.GH_NumberSlider> sliders)
  {
    if (index >= sliders.Count)
      return false;

    Grasshopper.Kernel.Special.GH_NumberSlider slider = sliders[index];
    if (slider.TickValue < slider.TickCount)
    {
      // Increment the slider.
      slider.TickValue++;
      return true;
    }
    else
    {
      // The current slider is already at the maximum value. Reset it back to zero.
      slider.TickValue = 0;

      // Move on to the next slider.
      index++;

      // If we've run out of sliders to modify, we're done permutatin'
      if (index >= sliders.Count)
        return false;

      return MoveToNextPermutation(ref index, sliders);
    }
  }
# ---------- end c_script ----------

range = Range(Domain=Slider(1000, range=0..1500), Steps=expr("x-1", simplify(Slider(30, range=0..100))))
pt_10 = ConstructPoint(XCoordinate=range, YCoordinate=0, ZCoordinate=0)
gh_cpython = GH_CPython(path="C:\Users\RFA4\Desktop\Sample", file="chair2.mat", load=Button())  # -> output, a; inputs path: list, file: list, load: list
#   port path: [required] - [type = int] - [default = None] Descripe your input here * bullet point. * bullet point
#   port output: indicate your output description here. refers to a new line.
# ---------- gh_cpython: Python ----------
import scipy.io
import Grasshopper as gh

mat = scipy.io.loadmat(path + "\\" + file)

#output_ = mat["instance"][0][0];



output_ = mat["instance"].tolist()

a = mat["instance"]
# ---------- end gh_cpython ----------
graft = GraftTree(Tree=pt_10, IncludeEmptyLists=True, IncludeNullItems=True)
Y = UnitY(Factor=range)
move_2 = Move(Geometry=graft, Motion=Y)  # -> Geometry, Transform
c_script_2 = CSharpScript(x=gh_cpython.output, n=Slider(30, range=0..100))  # -> out, A; inputs x: list of Int32, n: Int32
# ---------- c_script_2: C# ----------
    DataTree<int> tree = new DataTree<int>();

    int count = 0;
    for(int i = 0; i < n; i++){
      for(int s = 0; s < n; s++){
        for(int t = 0; t < n; t++){
          GH_Path path = new GH_Path(i, s,t);
          tree.Add(x[count], path);

          count++;
        }
      }
    }

    A = tree;
# ---------- end c_script_2 ----------
graft_2 = GraftTree(Tree=move_2.Geometry, IncludeEmptyLists=True, IncludeNullItems=True)
Z_3 = UnitZ(Factor=range)
item_8 = ListItem(List=range, Index=1, Wrap=True)
move_3 = Move(Geometry=graft_2, Motion=Z_3)  # -> simplify(Geometry), Transform
division_3 = Division(A=item_8, B=2)
graft_3 = GraftTree(Tree=move_3.Geometry, IncludeEmptyLists=True, IncludeNullItems=True)  # -> simplify(Tree)
item_9 = ListItem(List=flatten(graft_3), Index=Slider(24, range=0..1000), Wrap=True)
cull = CullPattern(List=graft_3, CullPattern=c_script_2.A)
box = CenterBox(Base=cull, X=division_3, Y=division_3, Z=division_3)
preview = CustomPreview(Geometry=box, Material=ColourSwatch(SwatchColor=RGB(102, 168, 255)))

gh_cpython_2 = GH_CPython(path="C:\Users\RFA4\Desktop\Sample", file="test2.mat", save=Button())  # -> output; inputs path: list, file: list, save: list
#   port output: indicate your output description here. refers to a new line.
# ---------- gh_cpython_2: Python ----------
import numpy as np
import scipy.io

data = np.arange(10)

if(save):
    scipy.io.savemat(path + "\\" + file, {'name':data})

output_ = data
# ---------- end gh_cpython_2 ----------
panel = Panel(gh_cpython_2)

gh_cpython_3 = GH_CPython()  # -> output
#   port output: indicate your output description here. refers to a new line.
# ---------- gh_cpython_3: Python ----------
import numpy as np

arr = np.empty((0,3,3),int)

arr = np.append(arr, np.array([[[1, 2, 3],[1, 2, 3],[1, 2, 3]]]), axis=0)
arr = np.append(arr, np.array([[[4, 5, 6],[4, 5, 6],[4, 5, 6]]]), axis=0)
arr = np.append(arr, np.array([[[7, 8, 9],[7, 8, 9],[7, 8, 9]]]), axis=0)

output_ = arr
# ---------- end gh_cpython_3 ----------
panel_2 = Panel(gh_cpython_3)

pt_11 = Point(end_2.Start)
item_10 = ListItem(List=pt_11, Index=0, Wrap=True)  # -> Item, Item1
ln_3 = Line(StartPoint=item_10.Item, EndPoint=item_10.Item1)
item_11 = ListItem(List=ln, Index=0, Wrap=True)
unit_2 = UnitVector(Vector=item_11)
crv = Curve(ln_2)
multiplication_2 = Multiplication(A=unit_2, B=背もたれ高_2)
divide = DivideCurve(Curve=crv, Count=背もたれ本数, Kinks=False)  # -> Points, Tangents, Parameters
move_4 = Move(Geometry=ln_3, Motion=multiplication_2)  # -> Geometry, Transform
end_4 = EndPoints(Curve=move_4.Geometry)  # -> Start, End
geo_2 = Geometry(orient.Geometry)
divide_2 = DivideCurve(Curve=move_4.Geometry, Count=背もたれ本数, Kinks=False)  # -> Points, Tangents, Parameters
area = Area(Geometry=geo_2)  # -> Area, Centroid
lng = ListLength(List=divide_2.Points)
lng_2 = ListLength(List=divide.Points)
vec2pt = Vector2Pt(PointA=area.Centroid, PointB=end_4.Start, Unitize=False)  # -> Vector, Length
subtraction_2 = Subtraction(A=lng, B=2)
subtraction_3 = Subtraction(A=lng_2, B=2)
move_5 = Move(Geometry=geo_2, Motion=vec2pt.Vector)  # -> Geometry, Transform
dom = ConstructDomain(DomainStart=1, DomainEnd=subtraction_2)
dom_2 = ConstructDomain(DomainStart=1, DomainEnd=subtraction_3)
extrude_4 = ExtrudeLinear(Profile=move_5.Geometry, OrientationP=move_5.Geometry, Axis=move_4.Geometry, OrientationA=move_5.Geometry)
subset = SubList(List=divide_2.Points, Domain=dom, Wrap=True)  # -> List, Index
subset_2 = SubList(List=divide.Points, Domain=dom_2, Wrap=True)  # -> List, Index
debrep_4 = DeconstructBrep(Brep=extrude_4)  # -> Faces, Edges, Vertices
ln_4 = Line(StartPoint=subset.List, EndPoint=subset_2.List)
item_12 = ListItem(List=debrep_4.Faces, Index="3", Wrap=True)
split_2 = SplitBrep(Brep=extrude_4, Cutter=item_6)  # -> flatten(Result)
item_13 = ListItem(List=split_2, Index=1, Wrap=True)  # -> flatten(Item)
split_3 = SplitBrep(Brep=item_13, Cutter=item_5)  # -> flatten(Result)
item_14 = ListItem(List=split_3, Index=1, Wrap=True)  # -> flatten(Item)

rev = ReverseList(List=subset_2.List)
rev_2 = ReverseList(List=subset.List)
item_15 = ListItem(List=subset.List, Index=0, Wrap=True)
item_16 = ListItem(List=rev, Index=0, Wrap=True)
item_17 = ListItem(List=subset_2.List, Index=0, Wrap=True)
item_18 = ListItem(List=rev_2, Index=0, Wrap=True)
ln_5 = Line(StartPoint=item_15, EndPoint=item_16)
ln_6 = Line(StartPoint=item_17, EndPoint=item_18)
pframe_2 = PerpFrame(Curve=ln_5, Parameter=0)
pframe_3 = PerpFrame(Curve=ln_6, Parameter=0)
geo_3 = Geometry(offset_2)
geo_4 = Geometry(offset_2)
orient_2 = Orient(Geometry=geo_3, Source=PlaneXY(0, 0, 0), Target=pframe_2)  # -> Geometry, Transform
orient_3 = Orient(Geometry=geo_4, Source=PlaneXY(0, 0, 0), Target=pframe_3)  # -> Geometry, Transform
extrude_5 = ExtrudeLinear(Profile=orient_2.Geometry, OrientationP=orient_2.Geometry, Axis=ln_5, OrientationA=pframe_2)
extrude_6 = ExtrudeLinear(Profile=orient_3.Geometry, OrientationP=orient_3.Geometry, Axis=ln_6, OrientationA=pframe_3)
join = BrepJoin(Breps=[extrude_5, extrude_6])  # -> Breps, Closed

extrude_7 = ExtrudeLinear(Profile=offset_2, OrientationP=PlaneXY(0, 0, 0), Axis=ln_4, OrientationA=subset.List)

split_4 = SplitBrep(Brep=extrude_7, Cutter=item_12)
item_19 = ListItem(List=split_4, Index=1, Wrap=True)  # -> flatten(Item)

join_2 = BrepJoin(Breps=[move.Geometry, extrude_3, extr, item_7, item_19, item_14, join.Breps])  # -> Breps, Closed
cluster = Cluster(
    geometry=join_2.Breps,
    path="C:\Users\RFA4\Desktop\Sample",
    size=Slider(1000, range=0..1500),
    file="chair2.mat",
    resolution=Slider(30, range=0..100),
    save=Button())

# ==== cluster Cluster
resolution = ClusterInput()
size = ClusterInput()
geometry = ClusterInput()
int = Integer(resolution)
path = ClusterInput()
file = ClusterInput()
save = ClusterInput()
int_2 = Integer(int)

num = Number(size)
geo = Geometry(flatten(geometry))
range = Range(Domain=num, Steps=expr("x-1", simplify(int)))
bbox = BoundingBox(Content=geo, Plane=PlaneXY(0, 0, 0), UnionBox=True)  # -> Box, Box_2
area = Area(Geometry=bbox.Box)  # -> Area, Centroid
pt = ConstructPoint(XCoordinate=range, YCoordinate=0, ZCoordinate=0)  # -> simplify(graft(Point))
pt_2 = ConstructPoint(XCoordinate=num, YCoordinate=num, ZCoordinate=0)
pt_3 = ConstructPoint(XCoordinate=num, YCoordinate=num, ZCoordinate=num)
pt_4 = ConstructPoint(XCoordinate=0, YCoordinate=0, ZCoordinate=0)
pdecon = Deconstruct(Point=area.Centroid)  # -> XComponent, YComponent, ZComponent
division = Division(A=pt_2, B=2)
box = Box2Pt(PointA=pt_4, PointB=pt_3, Plane=PlaneXY(0, 0, 0))
Z = UnitZ(Factor=range)
pt_5 = ConstructPoint(XCoordinate=pdecon.XComponent, YCoordinate=pdecon.YComponent, ZCoordinate=0)
item = ListItem(List=range, Index=1, Wrap=True)
orient = Orient(Geometry=geo, Source=pt_5, Target=division)  # -> Geometry, Transform
division_2 = Division(A=item, B=2)
mesh = Mesh(orient.Geometry)
mjoin = MeshJoin(Meshes=mesh)

Y = UnitY(Factor=range)
move = Move(Geometry=pt, Motion=Y)  # -> graft(Geometry), Transform

move_2 = Move(Geometry=move.Geometry, Motion=Z)  # -> Geometry, Transform
flatten = FlattenTree(Tree=move_2.Geometry, Path="{0}")
pull = PullPoint(Point=flatten, Geometry=mjoin, ClosestOnly=True)  # -> ClosestPoint, Distance
smaller = SmallerThan(FirstNumber=pull.Distance, SecondNumber=division_2)  # -> SmallerThan, OrEqualTo
cull = CullPattern(List=flatten, CullPattern=smaller.SmallerThan)

meshcp = MeshClosestPoint(Point=flatten, Mesh=mjoin)  # -> Point, Index, Parameter
vec2pt = Vector2Pt(PointA=flatten, PointB=meshcp.Point, Unitize=False)  # -> Vector, Length
meval = MeshEval(Mesh=mjoin, Parameter=meshcp.Parameter)  # -> Point, Normal, Colour
unit = UnitVector(Vector=vec2pt.Vector)
unit_2 = UnitVector(Vector=meval.Normal)
dprod = DotProduct(VectorA=unit_2, VectorB=unit, Unitize=False)
larger = LargerThan(FirstNumber=dprod, SecondNumber=Slider(0.01, range=0..1))  # -> LargerThan, OrEqualTo

or = GateOr(A=smaller.SmallerThan, B=larger.OrEqualTo)
cull_2 = CullPattern(List=flatten, CullPattern=or)

num_2 = Number(int)
int_3 = Integer(or)
gh_cpython = GH_CPython(path=path, file=file, data=int_3, n=int_2, save=save)  # -> output; inputs path: list, file: list, data: list, n: list, save: list
#   port output: indicate your output description here. refers to a new line.
# ---------- gh_cpython: Python ----------
import numpy as np
import scipy.io

arr = np.empty((0,n,n), int)

count = 0
for i in range(n):
    arrT = np.empty((0,n), int)
    for t in range(n):
        arrS = np.empty((0), int)
        for s in range(n):
            arrS = np.append(arrS, np.array( data[count] ))
            count += 1
        arrT = np.append(arrT,np.array([arrS]), axis=0)
    arr = np.append(arr, np.array([arrT]), axis=0)

output_ = arr

if(save):
    scipy.io.savemat(path + "\\" + file, {'instance':arr})
# ---------- end gh_cpython ----------

panel = Panel(num_2)
output = ClusterOutput(cull_2)
panel_2 = Panel(int_3)
