# Grasshopper definition bengal_b.gh (Grasshopper 1.0.4)

背もたれ上端高 = Slider(5, range=2..5, expression="x*100")
背もたれ中央幅 = Slider(2, range=1..4, expression="x*0.2")
背もたれ形状 = Slider(3, range=1..3, expression="x*2")
座面高さ = Slider(5, range=3..5, expression="x*100")
基本幅 = Slider(5, range=3..8, expression="x*100")
基本幅_2 = Slider(5, range=3..5, expression="x*100")
subtraction = Subtraction(A=座面高さ, B="50")
rectangle = Rectangle(Plane=PlaneXY(0, 0, 0), XSize=基本幅, YSize=背もたれ上端高, Radius=0)  # -> Rectangle, Length
rectangle_2 = Rectangle(Plane=PlaneXY(0, 0, 0), XSize=基本幅, YSize=基本幅_2, Radius=0)  # -> Rectangle, Length
geo = Geometry(rectangle_2.Rectangle)
Z = UnitZ(Factor=subtraction)
move = Move(Geometry=geo, Motion=Z)  # -> Geometry, Transform
debrep = DeconstructBrep(Brep=geo)  # -> Faces, Edges, Vertices
debrep_2 = DeconstructBrep(Brep=move.Geometry)  # -> Faces, Edges, Vertices
dom = ConstructDomain(DomainStart="-15", DomainEnd="15")
join = JoinCurves(Curves=debrep_2.Edges, Preserve=False)
rectangle_3 = Rectangle(Plane=PlaneXY(0, 0, 0), XSize=dom, YSize=dom, Radius=0)  # -> Rectangle, Length
ln = Line(StartPoint=debrep.Vertices, EndPoint=debrep_2.Vertices)
geo_2 = Geometry(rectangle_3.Rectangle)
orient = Orient(Geometry=geo_2, Source=PlaneXY(0, 0, 0), Target=debrep.Vertices)  # -> Geometry, Transform
offset = OffsetCurve(Curve=join, Distance="15", Plane=PlaneXY(0, 0, 0), Corners=1)
graft = GraftTree(Tree=ln, IncludeEmptyLists=True, IncludeNullItems=True)
graft_2 = GraftTree(Tree=orient.Geometry, IncludeEmptyLists=True, IncludeNullItems=True)
pt = Point(debrep.Vertices)
boundary = BoundarySurfaces(Edges=offset, UseTasks=True)
Z_2 = UnitZ(Factor="50")
swp1 = Sweep1(Rail=graft, Sections=graft_2, Miter=1)
item = ListItem(List=pt, Index="3", Wrap=True)
extr = Extrude(Base=boundary, Direction=Z_2)
xz = XZPlane(Origin=item)
Z_3 = UnitZ(Factor=座面高さ)
orient_2 = Orient(Geometry=rectangle.Rectangle, Source=PlaneXY(0, 0, 0), Target=xz)  # -> Geometry, Transform
move_2 = Move(Geometry=orient_2.Geometry, Motion=Z_3)  # -> Geometry, Transform
explode = Explode(Curve=move_2.Geometry, Recursive=True)  # -> Segments, Vertices
item_2 = ListItem(List=explode.Segments, Index=0, Wrap=True)  # -> Item, Item1, Item2, Item3
line = Line(item_2.Item3)
line_2 = Line(item_2.Item1)
end = EndPoints(Curve=line)  # -> Start, End
end_2 = EndPoints(Curve=line_2)  # -> Start, End
line_3 = Line(item_2.Item)
ln_2 = Line(StartPoint=end_2.End, EndPoint=end.Start)
mid = TK_MidPoint(C=line_3)  # -> P
# ---------- mid: Python ----------
import rhinoscriptsyntax as rs

if C!=None:
    P=rs.CurveMidPoint(C)
else:
    P=None
# ---------- end mid ----------
end_3 = EndPoints(Curve=line_3)  # -> Start, End
divide = DivideCurve(Curve=ln_2, Count=背もたれ形状, Kinks=False)  # -> Points, Tangents, Parameters
lng = ListLength(List=divide.Points)
ln_3 = Line(StartPoint=mid, EndPoint=end_3.Start)
subtraction_2 = Subtraction(A=lng, B=2)
eval = EvaluateCurve(Curve=ln_3, Parameter=背もたれ中央幅)  # -> Point, Tangent, Angle
cap = CapHoles(Brep=swp1)
ln_4 = Line(StartPoint=mid, EndPoint=eval.Point)
dom_2 = ConstructDomain(DomainStart="1", DomainEnd=subtraction_2)
range = Range(Domain=Domain(0, 1), Steps=dom_2)
yz = YZPlane(Origin=mid)
graph = GraphMapper(
    range,
    x0=0,
    x1=1,
    y0=0,
    y1=1,
    container_name="Sinc",
    Equation_X0=0.4993065,
    Equation_X1=0.6533645391,
    Equation_Y0=0.1040428281,
    Equation_Y1=0.06384807825)
subset = SubList(List=divide.Points, Domain=dom_2, Wrap=True)  # -> List, Index
mirror = Mirror(Geometry=ln_4, Plane=yz)  # -> Geometry, Transform
pdecon = Deconstruct(Point=subset.List)  # -> XComponent, YComponent, ZComponent
addition = Addition(A=graph, B=1)
join_2 = JoinCurves(Curves=[ln_4, mirror.Geometry], Preserve=False)
multiplication = Multiplication(A=pdecon.ZComponent, B=addition)
pt_2 = ConstructPoint(XCoordinate=pdecon.XComponent, YCoordinate=pdecon.YComponent, ZCoordinate=multiplication)
pt_3 = Point([end_2.Start, end_2.End])
pt_4 = Point([end.Start, end.End])
Y = UnitY(Factor="15")
ins = InsertItems(List=pt_2, Item=pt_3, Indices="0", Wrap=True)
lng_2 = ListLength(List=ins)
ins_2 = InsertItems(List=ins, Item=pt_4, Indices=lng_2, Wrap=True)
intcrv_t = InterpolateT(Vertices=ins_2, TangentStart=Vector(0, 0, 0), TangentEnd=Vector(0, 0, 0), KnotStyle=1)  # -> Curve, Length, Domain
reb = RebuildCurve(Curve=intcrv_t.Curve, Count="50", Tangents=False)
eval_2 = EvaluateCurve(Curve=intcrv_t.Curve, Parameter="0")  # -> Point, Tangent, Angle
pl = PlaneNormal(Origin=eval_2.Point, ZAxis=eval_2.Tangent)
orient_3 = Orient(Geometry=rectangle_3.Rectangle, Source=PlaneXY(0, 0, 0), Target=pl)  # -> Geometry, Transform
swp1_2 = Sweep1(Rail=reb, Sections=orient_3.Geometry, Miter=1)
debrep_3 = DeconstructBrep(Brep=swp1_2)  # -> Faces, Edges, Vertices
item_3 = ListItem(List=debrep_3.Faces, Index=0, Wrap=True)
project = Project(Curve=join_2, Brep=item_3, Direction=Vector(0, 0, 1))
rulesrf = RuledSurface(CurveA=join_2, CurveB=project)
extr_2 = Extrude(Base=rulesrf, Direction=Y)
brep = Brep([cap, extr, swp1_2, extr_2])
