# Grasshopper definition chinese_b.gh (Grasshopper 0.9.76)
# plug-ins: MeshEdit Components, Python Interpreter, BetaSpeckle, Flux.Grasshopper, Weaverbird

座面高さ = Slider(4, range=4..5, expression="x*100")
脚太さ_座面厚み = Slider(2, range=2..4, expression="x*10")
背もたれ抜き高さ = Slider(1, range=1..4, expression="x*0.2")
背もたれ上端高さ = Slider(4, range=4..6, expression="x*100")
背もたれ抜き幅 = Slider(0, range=0..5, expression="x*0.2")
基本奥行 = Slider(2, range=2..3, expression="x*200")
基本幅 = Slider(2, range=2..5, expression="x*200")
vec = VectorXYZ(XComponent=基本幅, YComponent=基本奥行, ZComponent=座面高さ)  # -> Vector, Length
division = Division(A=脚太さ_座面厚み, B=-2)
pt = Point(Point(0, 0, 0))
pt_2 = ConstructPoint(XCoordinate=division, YCoordinate=division, ZCoordinate=0)
box = Box2Pt(PointA=pt, PointB=vec.Vector, Plane=PlaneXY(0, 0, 0))
mesh = MeshBrep(
    Brep=box,
    Settings={GridMaxCount=0, GridMinCount=16, JaggedSeams=False, MaxEdgeLength=0, MinEdgeLength=0.0001, MinTolerance=0, Refine=True, RefineAngle=0, RelativeTolerance=0.65, SimplePlanes=True, Tolerance=0})
rectangle = Rectangle(Plane=pt_2, XSize=脚太さ_座面厚み, YSize=脚太さ_座面厚み, Radius=0)  # -> Rectangle, Length
wbedges = WeaverbirdsMeshEdges(MeshOrPolylines=mesh)
explode = MeshExplode(Mesh=mesh, Interpolate=False)
panel = Panel("""0
2
5
8""")
item = ListItem(List=explode, Index="4", Wrap=True)  # -> Item, Item1
item_2 = ListItem(List=wbedges, Index=panel, Wrap=True)
mesh_2 = Mesh(item.Item)
orient = Orient(Geometry=rectangle.Rectangle, Source=PlaneXY(0, 0, 0), Target=item_2)  # -> Geometry, Transform
extrude = ExtrudeLinear(Profile=orient.Geometry, OrientationP=orient.Geometry, Axis=item_2, OrientationA=orient.Geometry)
wbedges_2 = WeaverbirdsMeshEdges(MeshOrPolylines=mesh_2)
Z = UnitZ(Factor="50")
join = JoinCurves(Curves=wbedges_2, Preserve=False)
Z_2 = UnitZ(Factor=座面高さ)
move = Move(Geometry=join, Motion=Z)  # -> Geometry, Transform
multiplication = Multiplication(A=脚太さ_座面厚み, B=0.5)
multiplication_2 = Multiplication(A=脚太さ_座面厚み, B=-0.5)
multiplication_3 = Multiplication(A=脚太さ_座面厚み, B=-0.5)
move_2 = Move(Geometry=join, Motion=Z_2)  # -> Geometry, Transform
join_2 = JoinCurves(Curves=move_2.Geometry, Preserve=False)
offset = Offset(Curve=move.Geometry, Distance=graft([multiplication, multiplication_2]), Plane=PlaneXY(0, 0, 0), Corners=1)
offset_2 = Offset(Curve=join_2, Distance=multiplication_3, Plane=PlaneXY(0, 0, 0), Corners=1)
bang = ExplodeTree(Data=offset)  # -> _0000, _0010
boundary = BoundarySurfaces(Edges=offset_2)
Z_3 = UnitZ(Factor=脚太さ_座面厚み)
boundary_2 = BoundarySurfaces(Edges=flatten([bang._0000, bang._0010]))
Z_4 = UnitZ(Factor=脚太さ_座面厚み)
extr = Extrude(Base=boundary, Direction=Z_3)
extr_2 = Extrude(Base=boundary_2, Direction=Z_4)
debrep = DeconstructBrep(Brep=extr)  # -> Faces, Edges, Vertices
item_3 = ListItem(List=debrep.Vertices, Index="8", Wrap=True)  # -> Item, Item1
Z_5 = UnitZ(Factor=背もたれ上端高さ)
move_3 = Move(Geometry=[item_3.Item, item_3.Item1], Motion=Z_5)  # -> Geometry, Transform
item_4 = ListItem(List=move_3.Geometry, Index=0, Wrap=True)  # -> Item, Item1
division_2 = Division(A=脚太さ_座面厚み, B=-2)
ln = Line(StartPoint=item_3.Item, EndPoint=item_3.Item1)
X = UnitX(Factor=division_2)
mid = TK_MidPoint(C=ln)  # -> P
# ---------- mid: Python ----------
import rhinoscriptsyntax as rs

if C!=None:
    P=rs.CurveMidPoint(C)
else:
    P=None
# ---------- end mid ----------
cap = CapHoles(Brep=extrude)
trim = TrimSolid(Shape=extr_2, Cutters=cap)
srf4pt = _4PointSurface(CornerA=item_3.Item, CornerB=item_3.Item1, CornerC=item_4.Item1, CornerD=item_4.Item)
ln_2 = Line(StartPoint=item_3.Item, EndPoint=mid)
move_4 = Move(Geometry=item_3.Item, Motion=X)  # -> Geometry, Transform
eval = EvaluateCurve(Curve=ln_2, Parameter=背もたれ抜き幅)  # -> Point, Tangent, Angle
Z_6 = UnitZ(Factor=1)
ln_3 = Line(StartPoint=eval.Point, EndPoint=move_4.Geometry)
xz = XZPlane(Origin=eval.Point)
multiplication_4 = Multiplication(A=背もたれ上端高さ, B=背もたれ抜き高さ)
len = Length(Curve=ln_3)
line = LineSDL(Start=mid, Direction=Z_6, Length=1)
rectangle_2 = Rectangle(Plane=xz, XSize=len, YSize=multiplication_4, Radius=0)  # -> Rectangle, Length
mirror = MirrorCurve(Geometry=rectangle_2.Rectangle, Curve=line, Tangent=True)
crv = Curve(flatten([rectangle_2.Rectangle, mirror]))
rdiff = RegionDifference(CurvesA=srf4pt, CurvesB=crv)
boundary_3 = BoundarySurfaces(Edges=rdiff)
Y = UnitY(Factor=expr("x*(-1)", 脚太さ_座面厚み))
extr_3 = Extrude(Base=boundary_3, Direction=Y)
c_script = CSharpScript(folder="C:\ParametricImages\", makeimages=Button())  # -> out, A; inputs folder: String, makeimages: Boolean
# ---------- c_script: C# ----------
    if (!makeimages)
      return;

    if (_running)
      return;

    if (!System.IO.Directory.Exists(folder))
      System.IO.Directory.CreateDirectory(folder);

    _folder = folder;
    _run = true;
    GrasshopperDocument.SolutionEnd += OnSolutionEnd;
# ---------- c_script: C# additional code ----------
  private bool _run = false;
  private bool _running = false;
  private string _folder;

  private void OnSolutionEnd(object sender, GH_SolutionEventArgs e)
  {
    // Unregister the event, we don't want to get called again.
    e.Document.SolutionEnd -= OnSolutionEnd;

    // If we're not supposed to run, abort now.
    if (!_run)
      return;

    // If we're already running, abort now.
    if (_running)
      return;

    // Reset run and running states.
    _run = false;
    _running = true;

    try
    {
      // Find all sliders.
      List<Grasshopper.Kernel.Special.GH_NumberSlider> sliders = new List<Grasshopper.Kernel.Special.GH_NumberSlider>();
      foreach (IGH_DocumentObject docObject in GrasshopperDocument.Objects)
      {
        Grasshopper.Kernel.Special.GH_NumberSlider slider = docObject as Grasshopper.Kernel.Special.GH_NumberSlider;
        if (slider == null)
          continue;
        sliders.Add(slider);
      }
      if (sliders.Count == 0)
      {
        System.Windows.Forms.MessageBox.Show("No sliders could be found", "<harsh buzzing sound>", MessageBoxButtons.OK);
        return;
      }

      // Set all sliders back to zero.
      //GH_Document.EnableSolutions = false;
      foreach (Grasshopper.Kernel.Special.GH_NumberSlider slider in sliders)
        slider.TickValue = 0;

      // Start a giant loop in which we'll permutate our way across all slider layouts.
      int imageNumber = 0;
      while (true)
      {
        int idx = 0;
        if (!MoveToNextPermutation(ref idx, sliders))
          break;

        // We've just got a new valid permutation. Solve the new solution.
        e.Document.NewSolution(false);
        Rhino.RhinoDoc.ActiveDoc.Views.Redraw();

        Rhino.Display.RhinoView view = RhinoDocument.Views.Find("Perspective", false);
        if (view == null)
          break;

        string fileName = string.Format("{0}\\{1}.png", _folder, imageNumber);
        imageNumber++;

        Bitmap image = view.CaptureToBitmap();
        if (image == null)
          continue;

        image.Save(fileName);
        image.Dispose();
        image = null;
      }
    }
    catch(Exception ex)
    {
      // Ehm, exception, best swallow it here lest it totally crashes everything.
    }
    finally
    {
      // Always make sure that _running is switched off.
      _running = false;
    }
  }

  private bool MoveToNextPermutation(ref int index, List<Grasshopper.Kernel.Special.GH_NumberSlider> sliders)
  {
    if (index >= sliders.Count)
      return false;

    Grasshopper.Kernel.Special.GH_NumberSlider slider = sliders[index];
    if (slider.TickValue < slider.TickCount)
    {
      // Increment the slider.
      slider.TickValue++;
      return true;
    }
    else
    {
      // The current slider is already at the maximum value. Reset it back to zero.
      slider.TickValue = 0;

      // Move on to the next slider.
      index++;

      // If we've run out of sliders to modify, we're done permutatin'
      if (index >= sliders.Count)
        return false;

      return MoveToNextPermutation(ref index, sliders);
    }
  }
# ---------- end c_script ----------
number_slider = Slider(188, range=0..1000)
join_3 = BrepJoin(Breps=[trim, cap, extr, extr_3])  # -> Breps, Closed
flux = FluxProject(project="a52JBkDVmnGO181Nn")  # -> Keys, Meta; disabled
flow_control = FlowControl({"Once", "Constantly"}, selected="Constantly")  # disabled
flatten = FlattenTree(Path="{0}")  # disabled
rectangle_3 = Rectangle(Plane=PlaneXY(0, 0, 0), XSize=number_slider, YSize=number_slider, Radius=0)  # -> Rectangle, Length
to_flux = ToFlux(
    Keys=flux.Keys,
    Value=flatten,
    Mode=flow_control,
    isNotificationEnabled=True,
    keyId="40b1527cdb473a50815a3f5c439d2be8",
    projectId="a52JBkDVmnGO181Nn",
    Branch0_Path="{0}",
    Branch0_Item0_TypeName="Grasshopper.Kernel.Types.GH_Brep",
    Branch0_Item1_TypeName="Grasshopper.Kernel.Types.GH_Brep",
    Branch0_Item2_TypeName="Grasshopper.Kernel.Types.GH_Brep",
    Branch0_Item3_TypeName="Grasshopper.Kernel.Types.GH_Brep",
    Branch0_Item4_TypeName="Grasshopper.Kernel.Types.GH_Brep",
    Branch0_Item5_TypeName="Grasshopper.Kernel.Types.GH_Brep",
    Branch0_Item6_TypeName="Grasshopper.Kernel.Types.GH_Brep")  # disabled
bspk = BetaSpeckle(SLD=[基本幅, 基本奥行, 座面高さ, 脚太さ_座面厚み, 背もたれ抜き幅, 背もたれ抜き高さ, 背もたれ上端高さ], OBJ=join_3.Breps)
