# Grasshopper definition chinese_c.gh (Grasshopper 1.0.4)

背もたれ上端高 = Slider(6, range=4..6, expression="x*100")
基本奥行 = Slider(8, range=6..8, expression="x*100")
基本奥行_2 = Slider(4, range=1..4, expression="x*50")
座面高 = Slider(5, range=3..5, expression="x*100")
基本奥行_3 = Slider(3, range=1..3, expression="x*100")
肘掛け高 = Slider(2, range=1..2, expression="x*100")
基本幅 = Slider(10, range=6..10, expression="x*100")
rectangle = Rectangle(Plane=PlaneXY(0, 0, 0), XSize=基本幅, YSize=基本奥行, Radius=基本奥行_2)  # -> Rectangle, Length
Z = UnitZ(Factor=座面高)
geo = Geometry(rectangle.Rectangle)
remap = RemapNumbers(Value=基本奥行_2, Source="50 to 200", Target="1 to 2")  # -> Mapped, Clipped
move = Move(Geometry=geo, Motion=Z)  # -> Geometry, Transform
multiplication = Multiplication(A=remap.Mapped, B=-1)
Z_2 = UnitZ(Factor=expr("x*-1", 基本奥行_3))
boundary = BoundarySurfaces(Edges=move.Geometry)
division = Division(A=基本奥行_2, B=multiplication)
offset = OffsetCurve(Curve=rectangle.Rectangle, Distance=division, Plane=PlaneXY(0, 0, 0), Corners=1)
bbox = BoundingBox(Content=rectangle.Rectangle, Plane=PlaneXY(0, 0, 0))  # -> Box, Box_2
rectangle_2 = Rectangle(Plane=PlaneXY(0, 0, 0), XSize="-20 to 20", YSize="-20 to 20", Radius=0)  # -> Rectangle, Length
bbox_2 = BoundingBox(Content=offset, Plane=PlaneXY(0, 0, 0))  # -> Box, Box_2
area = Area(Geometry=bbox.Box)  # -> Area, Centroid
debrep = DeconstructBrep(Brep=bbox.Box)  # -> Faces, Edges, Vertices
debrep_2 = DeconstructBrep(Brep=bbox_2.Box)  # -> Faces, Edges, Vertices
rectangle_3 = Rectangle(Plane=PlaneXY(0, 0, 0), XSize=基本幅, YSize=背もたれ上端高, Radius=基本奥行_2)  # -> Rectangle, Length
item = ListItem(List=debrep.Vertices, Index="3", Wrap=True)
geo_2 = Geometry(debrep_2.Vertices)
xz = XZPlane(Origin=item)
subtraction = Subtraction(A=座面高, B=基本奥行_3)
orient = Orient(Geometry=rectangle_2.Rectangle, Source=PlaneXY(0, 0, 0), Target=geo_2)  # -> Geometry, Transform
orient_2 = Orient(Geometry=rectangle_3.Rectangle, Source=PlaneXY(0, 0, 0), Target=xz)  # -> Geometry, Transform
boundary_2 = BoundarySurfaces(Edges=orient.Geometry)
Z_3 = UnitZ(Factor=subtraction)
Z_4 = UnitZ(Factor=座面高)
move_2 = Move(Geometry=orient_2.Geometry, Motion=Z_4)  # -> Geometry, Transform
boundary_3 = BoundarySurfaces(Edges=move_2.Geometry)
Y = UnitY(Factor="-100")
extr = Extrude(Base=boundary, Direction=Z_2)
extr_2 = Extrude(Base=boundary_2, Direction=Z_3)
extr_3 = Extrude(Base=boundary_3, Direction=Y)
debrep_3 = DeconstructBrep(Brep=extr)  # -> Faces, Edges, Vertices
Z_5 = UnitZ(Factor=肘掛け高)
item_2 = ListItem(List=debrep_3.Edges, Index="3", Wrap=True)
move_3 = Move(Geometry=item_2, Motion=Z_5)  # -> Geometry, Transform
loft = Loft(
    Curves=[item_2, move_3.Geometry],
    Options={Adjust=False, Closed=False, LoftEnds=0, LoftSimp=0, LoftType=0, Rebuild=10, Refit=0.01})
X = UnitX(Factor="100")
yz = YZPlane(Origin=area.Centroid)
extr_4 = Extrude(Base=loft, Direction=X)
mirror = Mirror(Geometry=extr_4, Plane=yz)  # -> Geometry, Transform
join = BrepJoin(Breps=[extr, mirror.Geometry, extr_4, extr_2, extr_3])  # -> Breps, Closed
