# Grasshopper definition hindhi_b.gh (Grasshopper 0.9.76)
# plug-ins: Python Interpreter

背もたれ丸角半径 = Slider(3, range=1..3, expression="x*30")
肘掛け巻サイズ = Slider(12, range=9..12)
背もたれ高さ = Slider(5, range=3..5, expression="x*50")
座面高 = Slider(4, range=3..5, expression="x*100")
座面厚 = Slider(2, range=1..4, expression="x*50")
基本幅 = Slider(2, range=2..5, expression="x*200")
rectangle = Rectangle(Plane=PlaneXY(0, 0, 0), XSize=基本幅, YSize="500", Radius=0)  # -> Rectangle, Length
subtraction = Subtraction(A=座面高, B=座面厚)
offset = Offset(Curve=rectangle.Rectangle, Distance="35", Plane=PlaneXY(0, 0, 0), Corners=1)
Z = UnitZ(Factor=subtraction)
crv = Curve(offset)
move = Move(Geometry=crv, Motion=Z)  # -> Geometry, Transform
boundary = BoundarySurfaces(Edges=move.Geometry)
Z_2 = UnitZ(Factor=座面厚)
extr = Extrude(Base=boundary, Direction=Z_2)
box = Box(extr)
move_2 = Move(Geometry=rectangle.Rectangle, Motion=Z)  # -> Geometry, Transform
range = Range(Domain=Domain(0, 1), Steps=10)
crv_2 = Curve(rectangle.Rectangle)
debrep = DeconstructBrep(Brep=move_2.Geometry)  # -> Faces, Edges, Vertices
debrep_2 = DeconstructBrep(Brep=crv_2)  # -> Faces, Edges, Vertices
graph = GraphMapper(range, x0=0, x1=1, y0=0, y1=1, container_name="Sine", Equation_px=[0, 0.5014856458], Equation_py=[0, 0.06889629364])
debrep_3 = DeconstructBrep(Brep=box)  # -> Faces, Edges, Vertices
ln = Line(StartPoint=debrep.Vertices, EndPoint=debrep_2.Vertices)
series = Series(Start=0, Step=1, Count=肘掛け巻サイズ)
fib = Fibonacci(SeedA=0, SeedB=1, Number=肘掛け巻サイズ)
dup = DuplicateData(Data=graph, Number="4", Order=True)
item = ListItem(List=debrep_3.Edges, Index="7", Wrap=True)
divide = DivideCurve(Curve=ln, Count=10, Kinks=False)  # -> Points, Tangents, Parameters
rev = ReverseList(List=fib)
partition = PartitionList(List=dup, Size=11)
end = EndPoints(Curve=item)  # -> Start, End
Z_3 = UnitZ(Factor=1)
shift = ShiftList(List=rev, Shift="2", Wrap=True)
pdecon = Deconstruct(Point=divide.Points)  # -> XComponent, YComponent, ZComponent
debrep_4 = DeconstructBrep(Brep=rectangle.Rectangle)  # -> Faces, Edges, Vertices
line = LineSDL(Start=end.Start, Direction=Z_3, Length=Slider(150, range=0..1000))
lng = ListLength(List=shift)
multiplication = Multiplication(A=pdecon.XComponent, B=partition)
multiplication_2 = Multiplication(A=pdecon.XComponent, B=partition)
item_2 = ListItem(List=debrep_4.Vertices, Index=0, Wrap=True)  # -> Item, Item1, Item2, Item3
end_2 = EndPoints(Curve=line)  # -> Start, End
subtraction_2 = Subtraction(A=lng, B=3)
multiplication_3 = Multiplication(A=基本幅, B=0.5)
pt = ConstructPoint(XCoordinate=multiplication, YCoordinate=multiplication_2, ZCoordinate=pdecon.ZComponent)
pt_2 = Point(item_2.Item1)
pt_3 = Point(item_2.Item2)
pt_4 = PointCylindrical(BasePlane=PlaneXY(0, 0, 0), Angle=series, Radius=shift, Elevation=0)
yz = YZPlane(Origin=end_2.End)
dom = ConstructDomain(DomainStart=0, DomainEnd=subtraction_2)
multiplication_4 = Multiplication(A=multiplication_3, B=-1)
pt_5 = Point([end_2.Start, end_2.End])
ln_2 = Line(StartPoint=pt_2, EndPoint=pt_3)
intcrv = Interpolate(Vertices=pt, Degree=3, Periodic=False, KnotStyle=1)  # -> Curve, Length, Domain
xz = XZPlane(Origin=yz)
item_3 = ListItem(List=pt_4, Index=0, Wrap=True)
subset = SubList(List=pt_4, Domain=dom, Wrap=True)  # -> List, Index
mid = TK_MidPoint(C=ln_2)  # -> P
# ---------- mid: Python ----------
import rhinoscriptsyntax as rs

if C!=None:
    P=rs.CurveMidPoint(C)
else:
    P=None
# ---------- end mid ----------
dom_2 = ConstructDomain(DomainStart=multiplication_4, DomainEnd=multiplication_3)
multiplication_5 = Multiplication(A=背もたれ高さ, B=2)
reb = RebuildCurve(Curve=intcrv.Curve, Count=5, Tangents=False)
item_4 = ListItem(List=debrep_2.Vertices, Index=0, Wrap=True)  # -> Item, Item1, Item2, Item3
intcrv_2 = Interpolate(Vertices=subset.List, Degree=3, Periodic=False, KnotStyle=1)  # -> Curve, Length, Domain
xz_2 = XZPlane(Origin=mid)
bang = ExplodeTree(Data=reb)  # -> _0000, _0001, _0002, _0003
orient = Orient(Geometry=intcrv_2.Curve, Source=item_3, Target=xz)  # -> Geometry, Transform
pt_6 = Point(Point(0, 0, 0))
pt_7 = Point([item_4.Item1, item_4.Item2, item_4.Item3])
rectangle_2 = Rectangle(Plane=xz_2, XSize=dom_2, YSize=multiplication_5, Radius=背もたれ丸角半径)  # -> Rectangle, Length
Z_4 = UnitZ(Factor=座面高)
eval = EvaluateCurve(Curve=orient.Geometry, Parameter=0)  # -> Point, Tangent, Angle
pipe = Pipe(Curve=bang._0002, Radius="15", Caps=1)
vec2pt = Vector2Pt(PointA=pt_6, PointB=pt_7, Unitize=False)  # -> Vector, Length
move_3 = Move(Geometry=rectangle_2.Rectangle, Motion=Z_4)  # -> Geometry, Transform
intcrv_t = InterpolateT(Vertices=pt_5, Degree=3, TangentStart=Vector(0, 0, 0), TangentEnd=eval.Tangent, KnotStyle=1)  # -> Curve, Length, Domain
Y = UnitY(Factor=expr("x*-1", "100"))
move_4 = Move(Geometry=pipe, Motion=vec2pt.Vector)  # -> Geometry, Transform
boundary_2 = BoundarySurfaces(Edges=move_3.Geometry)
join = JoinCurves(Curves=[orient.Geometry, intcrv_t.Curve], Preserve=False)
item_5 = ListItem(List=move_4.Geometry, Index=0, Wrap=True)  # -> Item, Item1, Item2
num = Number(expr("rad(x)", "270"))
num_2 = Number(expr("rad(x)", "180"))
num_3 = Number(expr("rad(x)", "90"))
extr_2 = Extrude(Base=boundary_2, Direction=Y)
swp1 = Sweep1(Rail=item, Sections=join, Miter=1)
rotate = Rotate(Geometry=item_5.Item, Angle=num, Plane=item_4.Item1)  # -> Geometry, Transform
rotate_2 = Rotate(Geometry=item_5.Item1, Angle=num_2, Plane=item_4.Item2)  # -> Geometry, Transform
rotate_3 = Rotate(Geometry=item_5.Item2, Angle=num_3, Plane=item_4.Item3)  # -> Geometry, Transform
geo = Geometry(pipe)
offset_2 = Offset(Surface=swp1, Distance="10", Retrim=True)
division = Division(A=基本幅, B=2)
loft = Loft(
    Curves=[swp1, offset_2],
    Options={Adjust=False, Closed=False, LoftEnds=0, LoftSimp=0, LoftType=0, Rebuild=10, Refit=0.01})
pt_8 = ConstructPoint(XCoordinate=division, YCoordinate=0, ZCoordinate=0)
yz_2 = YZPlane(Origin=pt_8)
join_2 = BrepJoin(Breps=[swp1, loft, offset_2])  # -> Breps, Closed
mirror = Mirror(Geometry=join_2.Breps, Plane=yz_2)  # -> Geometry, Transform
brep = Brep([geo, rotate.Geometry, rotate_2.Geometry, rotate_3.Geometry, extr_2, box, join_2.Breps, mirror.Geometry])
