# Grasshopper definition hindhi_c.gh (Grasshopper 1.0.4)

背もたれ上端高 = Slider(5, range=2..5, expression="x*100")
背もたれ支柱 = Slider(2, range=2..5, expression="x*2")
座面高さ = Slider(3, range=3..5, expression="x*100")
基本幅 = Slider(3, range=3..8, expression="x*100")
基本幅_2 = Slider(5, range=3..5, expression="x*100")
subtraction = Subtraction(A=座面高さ, B="50")
rectangle = Rectangle(Plane=PlaneXY(0, 0, 0), XSize=基本幅, YSize=背もたれ上端高, Radius=0)  # -> Rectangle, Length
rectangle_2 = Rectangle(Plane=PlaneXY(0, 0, 0), XSize=基本幅, YSize=基本幅_2, Radius=0)  # -> Rectangle, Length
geo = Geometry(rectangle_2.Rectangle)
Z = UnitZ(Factor=subtraction)
move = Move(Geometry=geo, Motion=Z)  # -> Geometry, Transform
debrep = DeconstructBrep(Brep=geo)  # -> Faces, Edges, Vertices
debrep_2 = DeconstructBrep(Brep=move.Geometry)  # -> Faces, Edges, Vertices
dom = ConstructDomain(DomainStart="-15", DomainEnd="15")
join = JoinCurves(Curves=debrep_2.Edges, Preserve=False)
rectangle_3 = Rectangle(Plane=PlaneXY(0, 0, 0), XSize=dom, YSize=dom, Radius=0)  # -> Rectangle, Length
ln = Line(StartPoint=debrep.Vertices, EndPoint=debrep_2.Vertices)
geo_2 = Geometry(rectangle_3.Rectangle)
orient = Orient(Geometry=geo_2, Source=PlaneXY(0, 0, 0), Target=debrep.Vertices)  # -> Geometry, Transform
offset = OffsetCurve(Curve=join, Distance="15", Plane=PlaneXY(0, 0, 0), Corners=1)
graft = GraftTree(Tree=ln, IncludeEmptyLists=True, IncludeNullItems=True)
graft_2 = GraftTree(Tree=orient.Geometry, IncludeEmptyLists=True, IncludeNullItems=True)
pt = Point(debrep.Vertices)
boundary = BoundarySurfaces(Edges=offset, UseTasks=True)
Z_2 = UnitZ(Factor="50")
item = ListItem(List=pt, Index="3", Wrap=True)
swp1 = Sweep1(Rail=graft, Sections=graft_2, Miter=1)
xz = XZPlane(Origin=item)
extr = Extrude(Base=boundary, Direction=Z_2)
Z_3 = UnitZ(Factor=座面高さ)
orient_2 = Orient(Geometry=rectangle.Rectangle, Source=PlaneXY(0, 0, 0), Target=xz)  # -> Geometry, Transform
move_2 = Move(Geometry=orient_2.Geometry, Motion=Z_3)  # -> Geometry, Transform
explode = Explode(Curve=move_2.Geometry, Recursive=True)  # -> Segments, Vertices
item_2 = ListItem(List=explode.Segments, Index=0, Wrap=True)  # -> Item, Item1, Item2, Item3
join_2 = JoinCurves(Curves=[item_2.Item1, item_2.Item2, item_2.Item3], Preserve=False)
end = EndPoints(Curve=move_2.Geometry)  # -> Start, End
orient_3 = Orient(Geometry=rectangle_3.Rectangle, Source=PlaneXY(0, 0, 0), Target=end.End)  # -> Geometry, Transform
line = Line(item_2.Item)
line_2 = Line(item_2.Item1)
swp1_2 = Sweep1(Rail=join_2, Sections=orient_3.Geometry, Miter=1)
mid = TK_MidPoint(C=line)  # -> P
# ---------- mid: Python ----------
import rhinoscriptsyntax as rs

if C!=None:
    P=rs.CurveMidPoint(C)
else:
    P=None
# ---------- end mid ----------
end_2 = EndPoints(Curve=line)  # -> Start, End
divide = DivideCurve(Curve=line_2, Count=背もたれ支柱, Kinks=False)  # -> Points, Tangents, Parameters
ln_2 = Line(StartPoint=mid, EndPoint=end_2.Start)
lng = ListLength(List=divide.Points)
subtraction_2 = Subtraction(A=lng, B=2)
eval = EvaluateCurve(Curve=ln_2, Parameter=Slider(4, range=1..4, expression="x*0.2"))  # -> Point, Tangent, Angle
cap = CapHoles(Brep=swp1)
ln_3 = Line(StartPoint=mid, EndPoint=eval.Point)
xz_2 = XZPlane(Origin=mid)
dom_2 = ConstructDomain(DomainStart="1", DomainEnd=subtraction_2)
len = Length(Curve=ln_3)
len_2 = Length(Curve=ln_2)
len_3 = Length(Curve=ln_3)
X = UnitX(Factor=expr("x*-1", "15"))
subset = SubList(List=divide.Points, Domain=dom_2, Wrap=True)  # -> List, Index
subtraction_3 = Subtraction(A=len_2, B=len)
multiplication = Multiplication(A=len_3, B=-1)
subtraction_4 = Subtraction(A=subtraction_3, B="15")
dom_3 = ConstructDomain(DomainStart=len_3, DomainEnd=multiplication)
X_2 = UnitX(Factor=expr("x*-1", 1))
move_3 = Move(Geometry=subset.List, Motion=X)  # -> Geometry, Transform
subtraction_5 = Subtraction(A=背もたれ上端高, B="15")
line_3 = LineSDL(Start=move_3.Geometry, Direction=X_2, Length=subtraction_4)
multiplication_2 = Multiplication(A="7.5", B=-1)
end_3 = EndPoints(Curve=line_3)  # -> Start, End
dom_4 = ConstructDomain(DomainStart=multiplication_2, DomainEnd="7.5")
rectangle_4 = Rectangle(Plane=xz_2, XSize=dom_3, YSize=subtraction_5, Radius=0)  # -> Rectangle, Length
yz = YZPlane(Origin=end_3.Start)
rectangle_5 = Rectangle(Plane=PlaneXY(0, 0, 0), XSize=dom_4, YSize=dom_4, Radius=0)  # -> Rectangle, Length
boundary_2 = BoundarySurfaces(Edges=rectangle_4.Rectangle)
Y = UnitY(Factor="15")
orient_4 = Orient(Geometry=rectangle_5.Rectangle, Source=PlaneXY(0, 0, 0), Target=yz)  # -> Geometry, Transform
graft_3 = GraftTree(Tree=end_3.Start, IncludeEmptyLists=True, IncludeNullItems=True)
graft_4 = GraftTree(Tree=line_3, IncludeEmptyLists=True, IncludeNullItems=True)
extr_2 = Extrude(Base=boundary_2, Direction=Y)
graft_5 = GraftTree(Tree=orient_4.Geometry, IncludeEmptyLists=True, IncludeNullItems=True)
yz_2 = YZPlane(Origin=mid)
extrude = ExtrudeLinear(Profile=graft_5, OrientationP=graft_5, Axis=graft_4, OrientationA=graft_5)
brep = Brep(extrude)
mirror = Mirror(Geometry=brep, Plane=yz_2)  # -> Geometry, Transform
brep_2 = Brep([cap, extr, swp1_2, extr_2, mirror.Geometry, brep])
