# Grasshopper definition japan_a.gh (Grasshopper 0.9.76)

背もたれ上端高さ = Slider(8, range=8..10, expression="x*100")
座面オフセット = Slider(3, range=3..5, expression="x*10")
背もたれ高さ = Slider(-3, range=-3..-1, expression="x*100")
基本奥行 = Slider(3, range=3..6, expression="x*100")
座面高さ = Slider(3, range=3..5, expression="x*100")
脚径 = Slider(1, range=1..3, expression="x*10")
基本幅 = Slider(3, range=3..6, expression="x*100")
rectangle = Rectangle(Plane=PlaneXY(0, 0, 0), XSize=基本幅, YSize=基本奥行, Radius=0)  # -> Rectangle, Length
debrep = DeconstructBrep(Brep=rectangle.Rectangle)  # -> Faces, Edges, Vertices
graft = GraftTree(Tree=debrep.Vertices, IncludeEmptyLists=True, IncludeNullItems=True)  # -> simplify(Tree)
cir = Circle(Plane=graft, Radius=脚径)
bang = ExplodeTree(Data=cir)  # -> Branch0, Branch1, Branch2, Branch3
Z = UnitZ(Factor=座面高さ)
move = Move(Geometry=rectangle.Rectangle, Motion=Z)  # -> Geometry, Transform
Z_2 = UnitZ(Factor=座面高さ)
Z_3 = UnitZ(Factor=背もたれ上端高さ)
extr = Extrude(Base=[bang.Branch1, bang.Branch2], Direction=Z_3)
extr_2 = Extrude(Base=[bang.Branch0, bang.Branch3], Direction=Z_2)
offset = Offset(Curve=move.Geometry, Distance=座面オフセット, Plane=PlaneXY(0, 0, 0), Corners=1)
crv = Curve(reparameterize(bang.Branch1))
crv_2 = Curve(reparameterize(bang.Branch2))
Z_4 = UnitZ(Factor="30")
tarc = TangentArcs(CircleA=crv, CircleB=crv_2, Radius="600")  # -> ArcA, ArcB
boundary = BoundarySurfaces(Edges=offset)
Z_5 = UnitZ(Factor=背もたれ上端高さ)
crv_3 = Curve(tarc.ArcA)
Z_6 = UnitZ(Factor=背もたれ高さ)
move_2 = Move(Geometry=crv_3, Motion=Z_5)  # -> Geometry, Transform
move_3 = Move(Geometry=move_2.Geometry, Motion=Z_6)  # -> Geometry, Transform
loft = Loft(
    Curves=[move_2.Geometry, move_3.Geometry],
    Options={Adjust=False, Closed=False, LoftEnds=0, LoftSimp=0, LoftType=0, Rebuild=10, Refit=0.01})
Y = UnitY(Factor="30")
c_script = CSharpScript(folder="C:\ParametricImages\", makeimages=Button())  # -> out, A; inputs folder: String, makeimages: Boolean
# ---------- c_script: C# ----------
    if (!makeimages)
      return;

    if (_running)
      return;

    if (!System.IO.Directory.Exists(folder))
      System.IO.Directory.CreateDirectory(folder);

    _folder = folder;
    _run = true;
    GrasshopperDocument.SolutionEnd += OnSolutionEnd;
# ---------- c_script: C# additional code ----------
  private bool _run = false;
  private bool _running = false;
  private string _folder;

  private void OnSolutionEnd(object sender, GH_SolutionEventArgs e)
  {
    // Unregister the event, we don't want to get called again.
    e.Document.SolutionEnd -= OnSolutionEnd;

    // If we're not supposed to run, abort now.
    if (!_run)
      return;

    // If we're already running, abort now.
    if (_running)
      return;

    // Reset run and running states.
    _run = false;
    _running = true;

    try
    {
      // Find all sliders.
      List<Grasshopper.Kernel.Special.GH_NumberSlider> sliders = new List<Grasshopper.Kernel.Special.GH_NumberSlider>();
      foreach (IGH_DocumentObject docObject in GrasshopperDocument.Objects)
      {
        Grasshopper.Kernel.Special.GH_NumberSlider slider = docObject as Grasshopper.Kernel.Special.GH_NumberSlider;
        if (slider == null)
          continue;
        sliders.Add(slider);
      }
      if (sliders.Count == 0)
      {
        System.Windows.Forms.MessageBox.Show("No sliders could be found", "<harsh buzzing sound>", MessageBoxButtons.OK);
        return;
      }

      // Set all sliders back to zero.
      //GH_Document.EnableSolutions = false;
      foreach (Grasshopper.Kernel.Special.GH_NumberSlider slider in sliders)
        slider.TickValue = 0;

      // Start a giant loop in which we'll permutate our way across all slider layouts.
      int imageNumber = 0;
      while (true)
      {
        int idx = 0;
        if (!MoveToNextPermutation(ref idx, sliders))
          break;

        // We've just got a new valid permutation. Solve the new solution.
        e.Document.NewSolution(false);
        Rhino.RhinoDoc.ActiveDoc.Views.Redraw();

        Rhino.Display.RhinoView view = RhinoDocument.Views.Find("Perspective", false);
        if (view == null)
          break;

        string fileName = string.Format("{0}\\{1}.png", _folder, imageNumber);
        imageNumber++;

        Bitmap image = view.CaptureToBitmap();
        if (image == null)
          continue;

        image.Save(fileName);
        image.Dispose();
        image = null;
      }
    }
    catch(Exception ex)
    {
      // Ehm, exception, best swallow it here lest it totally crashes everything.
    }
    finally
    {
      // Always make sure that _running is switched off.
      _running = false;
    }
  }

  private bool MoveToNextPermutation(ref int index, List<Grasshopper.Kernel.Special.GH_NumberSlider> sliders)
  {
    if (index >= sliders.Count)
      return false;

    Grasshopper.Kernel.Special.GH_NumberSlider slider = sliders[index];
    if (slider.TickValue < slider.TickCount)
    {
      // Increment the slider.
      slider.TickValue++;
      return true;
    }
    else
    {
      // The current slider is already at the maximum value. Reset it back to zero.
      slider.TickValue = 0;

      // Move on to the next slider.
      index++;

      // If we've run out of sliders to modify, we're done permutatin'
      if (index >= sliders.Count)
        return false;

      return MoveToNextPermutation(ref index, sliders);
    }
  }
# ---------- end c_script ----------
cap = CapHoles(Brep=extr_2)
cap_2 = CapHoles(Brep=extr)
extr_3 = Extrude(Base=boundary, Direction=Z_4)
extr_4 = Extrude(Base=loft, Direction=Y)
