# Grasshopper definition japan_c.gh (Grasshopper 0.9.76)

脚太さ_座面厚み = Slider(2, range=2..4, expression="x*10")
座面高さ = Slider(4, range=4..5, expression="x*100")
背もたれ上端高さ = Slider(4, range=4..6, expression="x*100")
背もたれ細材本数 = Slider(2, range=2..5, expression="x*2")
背もたれ下端 = Slider(0, range=0..4, expression="x*0.2")
基本奥行 = Slider(2, range=2..3, expression="x*200")
基本幅 = Slider(2, range=2..5, expression="x*200")
rectangle = Rectangle(Plane=PlaneXY(0, 0, 0), XSize=基本幅, YSize=基本奥行, Radius=0)  # -> Rectangle, Length
debrep = DeconstructBrep(Brep=rectangle.Rectangle)  # -> Faces, Edges, Vertices
pt = Point(debrep.Vertices)
division = Division(A=脚太さ_座面厚み, B=-2)
multiplication = Multiplication(A=pt, B=-1)
rectangle_2 = Rectangle(Plane=PlaneXY(0, 0, 0), XSize=脚太さ_座面厚み, YSize=脚太さ_座面厚み, Radius=0)  # -> Rectangle, Length
line = LineSDL(Start=pt, Direction=Vector(0, 0, 1), Length=座面高さ)
Z = UnitZ(Factor=1)
X = UnitX(Factor=division)
Y = UnitY(Factor=division)
srf = Surface(debrep.Faces)
Z_2 = UnitZ(Factor=座面高さ)
move = Move(Geometry=rectangle_2.Rectangle, Motion=X)  # -> Geometry, Transform
move_2 = Move(Geometry=srf, Motion=Z_2)  # -> Geometry, Transform
move_3 = Move(Geometry=move.Geometry, Motion=Y)  # -> Geometry, Transform
offset = Offset(Curve=move_2.Geometry, Distance=脚太さ_座面厚み, Plane=PlaneXY(0, 0, 0), Corners=1)
extrude = ExtrudeLinear(Profile=move_3.Geometry, OrientationP=multiplication, Axis=line, OrientationA=Z)
Z_3 = UnitZ(Factor=脚太さ_座面厚み)
boundary = BoundarySurfaces(Edges=offset)
cap = CapHoles(Brep=extrude)
extr = Extrude(Base=boundary, Direction=Z_3)
debrep_2 = DeconstructBrep(Brep=cap)  # -> Faces, Edges, Vertices
item = ListItem(List=debrep_2.Faces, Index=0, Wrap=True)  # -> Item, Item1
srf_2 = Surface(item.Item1)
area = Area(Geometry=srf_2)  # -> Area, Centroid
bang = ExplodeTree(Data=area.Centroid)  # -> Branch0, Branch1, Branch2, Branch3
pt_2 = Point([bang.Branch1, bang.Branch2])
Z_4 = UnitZ(Factor=背もたれ上端高さ)
move_4 = Move(Geometry=pt_2, Motion=Z_4)  # -> Geometry, Transform
Y_2 = UnitY(Factor="100")
move_5 = Move(Geometry=move_4.Geometry, Motion=Y_2)  # -> Geometry, Transform
arc = ArcSED(Start=pt_2, End=move_5.Geometry, Direction=Vector(0, 0, 1))  # -> Arc, Plane, Radius
orient = Orient(Geometry=move_3.Geometry, Source=PlaneXY(0, 0, 0), Target=pt_2)  # -> Geometry, Transform
swp1 = Sweep1(Rail=arc.Arc, Sections=orient.Geometry, Miter=1)
debrep_3 = DeconstructBrep(Brep=swp1)  # -> Faces, Edges, Vertices
bang_2 = ExplodeTree(Data=debrep_3.Edges)  # -> _00100, _00200
item_2 = ListItem(List=bang_2._00100, Index=10, Wrap=True)
item_3 = ListItem(List=bang_2._00200, Index=11, Wrap=True)
crv = Curve(reparameterize([item_2, item_3]))
eval = EvaluateCurve(Curve=crv, Parameter=背もたれ下端)  # -> Point, Tangent, Angle
shatter = Shatter(Curve=crv, Parameters=背もたれ下端)
item_4 = ListItem(List=shatter, Index=0, Wrap=True)  # -> Item, Item1
crv_2 = Curve(item_4.Item)
crv_3 = Curve(item_4.Item1)
loft = Loft(Curves=flatten(crv_3), Options={Adjust=False, Closed=False, LoftEnds=0, LoftSimp=0, LoftType=0, Rebuild=10, Refit=0.01})
end = EndPoints(Curve=crv_2)  # -> Start, End
pt_3 = Point(simplify(end.Start))
offset_2 = Offset(Surface=loft, Distance=脚太さ_座面厚み, Retrim=True)
bang_3 = ExplodeTree(Data=pt_3)  # -> Branch0, Branch1
loft_2 = Loft(
    Curves=[loft, offset_2],
    Options={Adjust=False, Closed=False, LoftEnds=0, LoftSimp=0, LoftType=0, Rebuild=10, Refit=0.01})
ln = Line(StartPoint=bang_3.Branch0, EndPoint=bang_3.Branch1)
divide = DivideCurve(Curve=ln, Count=背もたれ細材本数, Kinks=True)  # -> Points, Tangents, Parameters
lng = ListLength(List=divide.Points)
bang_4 = ExplodeTree(Data=simplify(crv_2))  # -> Branch0, Branch1
subtraction = Subtraction(A=lng, B=2)
dom = ConstructDomain(DomainStart="1", DomainEnd=subtraction)
crv_4 = Curve(bang_4.Branch0)
subset = SubList(List=divide.Points, Domain=dom, Wrap=True)  # -> List, Index
end_2 = EndPoints(Curve=crv_4)  # -> Start, End
rec = Rectangle({Plane=PlaneXY(-5, -20, 0), Size=Domain2(u=0..10, v=0..20)})
orient_2 = Orient(Geometry=crv_4, Source=end_2.Start, Target=subset.List)  # -> graft(Geometry), Transform
orient_3 = Orient(Geometry=rec, Source=PlaneXY(0, 0, 0), Target=subset.List)  # -> graft(Geometry), Transform
c_script = CSharpScript(folder="C:\ParametricImages\", makeimages=Button())  # -> out, A; inputs folder: String, makeimages: Boolean
# ---------- c_script: C# ----------
    if (!makeimages)
      return;

    if (_running)
      return;

    if (!System.IO.Directory.Exists(folder))
      System.IO.Directory.CreateDirectory(folder);

    _folder = folder;
    _run = true;
    GrasshopperDocument.SolutionEnd += OnSolutionEnd;
# ---------- c_script: C# additional code ----------
  private bool _run = false;
  private bool _running = false;
  private string _folder;

  private void OnSolutionEnd(object sender, GH_SolutionEventArgs e)
  {
    // Unregister the event, we don't want to get called again.
    e.Document.SolutionEnd -= OnSolutionEnd;

    // If we're not supposed to run, abort now.
    if (!_run)
      return;

    // If we're already running, abort now.
    if (_running)
      return;

    // Reset run and running states.
    _run = false;
    _running = true;

    try
    {
      // Find all sliders.
      List<Grasshopper.Kernel.Special.GH_NumberSlider> sliders = new List<Grasshopper.Kernel.Special.GH_NumberSlider>();
      foreach (IGH_DocumentObject docObject in GrasshopperDocument.Objects)
      {
        Grasshopper.Kernel.Special.GH_NumberSlider slider = docObject as Grasshopper.Kernel.Special.GH_NumberSlider;
        if (slider == null)
          continue;
        sliders.Add(slider);
      }
      if (sliders.Count == 0)
      {
        System.Windows.Forms.MessageBox.Show("No sliders could be found", "<harsh buzzing sound>", MessageBoxButtons.OK);
        return;
      }

      // Set all sliders back to zero.
      //GH_Document.EnableSolutions = false;
      foreach (Grasshopper.Kernel.Special.GH_NumberSlider slider in sliders)
        slider.TickValue = 0;

      // Start a giant loop in which we'll permutate our way across all slider layouts.
      int imageNumber = 0;
      while (true)
      {
        int idx = 0;
        if (!MoveToNextPermutation(ref idx, sliders))
          break;

        // We've just got a new valid permutation. Solve the new solution.
        e.Document.NewSolution(false);
        Rhino.RhinoDoc.ActiveDoc.Views.Redraw();

        Rhino.Display.RhinoView view = RhinoDocument.Views.Find("Perspective", false);
        if (view == null)
          break;

        string fileName = string.Format("{0}\\{1}.png", _folder, imageNumber);
        imageNumber++;

        Bitmap image = view.CaptureToBitmap();
        if (image == null)
          continue;

        image.Save(fileName);
        image.Dispose();
        image = null;
      }
    }
    catch(Exception ex)
    {
      // Ehm, exception, best swallow it here lest it totally crashes everything.
    }
    finally
    {
      // Always make sure that _running is switched off.
      _running = false;
    }
  }

  private bool MoveToNextPermutation(ref int index, List<Grasshopper.Kernel.Special.GH_NumberSlider> sliders)
  {
    if (index >= sliders.Count)
      return false;

    Grasshopper.Kernel.Special.GH_NumberSlider slider = sliders[index];
    if (slider.TickValue < slider.TickCount)
    {
      // Increment the slider.
      slider.TickValue++;
      return true;
    }
    else
    {
      // The current slider is already at the maximum value. Reset it back to zero.
      slider.TickValue = 0;

      // Move on to the next slider.
      index++;

      // If we've run out of sliders to modify, we're done permutatin'
      if (index >= sliders.Count)
        return false;

      return MoveToNextPermutation(ref index, sliders);
    }
  }
# ---------- end c_script ----------
swp1_2 = Sweep1(Rail=orient_2.Geometry, Sections=orient_3.Geometry, Miter=1)
join = BrepJoin(Breps=[loft, offset_2, loft_2])  # -> Breps, Closed
brep = Brep(swp1)
brep_2 = Brep(extrude)
brep_3 = Brep(extr)
