# Grasshopper definition portugal_a.gh (Grasshopper 1.0.4)

背もたれ上端高さ = Slider(0, range=0..3, expression="x*100")
肘掛け上端幅 = Slider(4, range=2..4, expression="x*100")
基本奥行き = Slider(6, range=4..6, expression="x*100")
基本幅 = Slider(4, range=4..10, expression="x*100")
高さ = Slider(10, range=6..10, expression="x*100")
expression = Expression(x=基本奥行き, y=肘掛け上端幅, Expression="(x-y)/2")
pt = ConstructPoint(XCoordinate=0, YCoordinate=expression, ZCoordinate=0)
rectangle = Rectangle(Plane=pt, XSize=基本幅, YSize=肘掛け上端幅, Radius=0)  # -> Rectangle, Length
Z = UnitZ(Factor=高さ)
rectangle_2 = Rectangle(Plane=PlaneXY(0, 0, 0), XSize=基本幅, YSize=基本奥行き, Radius=0)  # -> Rectangle, Length
move = Move(Geometry=rectangle.Rectangle, Motion=Z)  # -> Geometry, Transform
geo = Geometry(rectangle_2.Rectangle)
debrep = DeconstructBrep(Brep=geo)  # -> Faces, Edges, Vertices
debrep_2 = DeconstructBrep(Brep=move.Geometry)  # -> Faces, Edges, Vertices
ln = Line(StartPoint=debrep.Vertices, EndPoint=debrep_2.Vertices)
item = ListItem(List=ln, Index=0, Wrap=True)  # -> Item, Item1, Item2, Item3
item_2 = ListItem(List=debrep_2.Edges, Index="1", Wrap=True)  # -> Item, Item1, Item2
line = Line(item.Item)
line_2 = Line(item.Item1)
line_3 = Line(item.Item2)
line_4 = Line(item.Item3)
line_5 = Line(item_2.Item)
line_6 = Line(item_2.Item2)
division = Division(A=高さ, B=2)
join = JoinCurves(Curves=[line, line_6, line_4], Preserve=False)
join_2 = JoinCurves(Curves=[line_2, line_5, line_3], Preserve=False)
rectangle_3 = Rectangle(Plane=PlaneXY(0, 0, 0), XSize="-20 to 20", YSize="-20 to 20", Radius=0)  # -> Rectangle, Length
mid = TK_MidPoint(C=line)  # -> P
# ---------- mid: Python ----------
import rhinoscriptsyntax as rs

if C!=None:
    P=rs.CurveMidPoint(C)
else:
    P=None
# ---------- end mid ----------
mid_2 = TK_MidPoint(C=line_4)  # -> P; same code as mid
mid_3 = TK_MidPoint(C=line_2)  # -> P; same code as mid
mid_4 = TK_MidPoint(C=line_3)  # -> P; same code as mid
addition = Addition(B="20")
subtraction = Subtraction(A=基本奥行き, B=100)
addition_2 = Addition(A=基本奥行き, B=100)
addition_3 = Addition(A=高さ, B=背もたれ上端高さ)
end = EndPoints(Curve=join_2)  # -> Start, End
ln_2 = Line(StartPoint=[mid, mid_4], EndPoint=[mid_2, mid_3])
orient = Orient(Geometry=rectangle_3.Rectangle, Source=PlaneXY(0, 0, 0), Target=end.Start)  # -> Geometry, Transform
pt_2 = ConstructPoint(XCoordinate=addition, YCoordinate=0, ZCoordinate=division)
pt_3 = ConstructPoint(XCoordinate=addition, YCoordinate=subtraction, ZCoordinate=division)
pt_4 = ConstructPoint(XCoordinate=addition, YCoordinate=addition_2, ZCoordinate=addition_3)
end_2 = EndPoints(Curve=ln_2)  # -> Start, End
swp1 = Sweep1(Rail=join, Sections=rectangle_3.Rectangle, Miter=1)
swp1_2 = Sweep1(Rail=join_2, Sections=orient.Geometry, Miter=1)
xz = XZPlane(Origin=end_2.Start)
intcrv = Interpolate(Vertices=[pt_2, pt_3, pt_4], Degree=3, Periodic=False, KnotStyle=1)  # -> Curve, Length, Domain
orient_2 = Orient(Geometry=rectangle_3.Rectangle, Source=PlaneXY(0, 0, 0), Target=xz)  # -> graft(Geometry), Transform
pt_5 = Point(pt_4)
swp1_3 = Sweep1(Rail=graft(ln_2), Sections=orient_2.Geometry, Miter=1)
subtraction_2 = Subtraction(A=基本幅, B=40)
X = UnitX(Factor=1)
item_3 = ListItem(List=pt_5, Index=0, Wrap=True)
line_7 = LineSDL(Start=item_3, Direction=X, Length=subtraction_2)
swp1_4 = Sweep1(Rail=line_7, Sections=intcrv.Curve, Miter=1)
offset = OffsetSurface(Surface=swp1_4, Distance="30", Retrim=True)
loft = Loft(
    Curves=[swp1_4, offset],
    Options={Adjust=False, Closed=False, LoftEnds=0, LoftSimp=0, LoftType=0, Rebuild=10, Refit=0.01})
cap = CapHoles(Brep=swp1)
cap_2 = CapHoles(Brep=swp1_2)
cap_3 = CapHoles(Brep=swp1_3)
join_3 = BrepJoin(Breps=[swp1_4, offset, loft])  # -> Breps, Closed

# ---- group: 360通り？
brep = Brep([cap, cap_2, cap_3, join_3.Breps])
