# Grasshopper definition portugal_b.gh (Grasshopper 1.0.4)

背もたれ支持材位置 = Slider(8, range=3..8, expression="x*0.1")
脚オフセット = Slider(-3, range=-3..-1, expression="x*50")
基本奥行き = Slider(6, range=4..6, expression="x*100")
座面高さ = Slider(4, range=4..6, expression="x*100")
基本奥行き_2 = Slider(6, range=3..6, expression="x*100")
基本幅 = Slider(5, range=2..5, expression="x*200")
rectangle = Rectangle(Plane=PlaneXY(0, 0, 0), XSize=基本幅, YSize=基本奥行き, Radius=0)  # -> Rectangle, Length
Z = UnitZ(Factor=座面高さ)
geo = Geometry(rectangle.Rectangle)
move = Move(Geometry=geo, Motion=Z)  # -> Geometry, Transform
offset = OffsetCurve(Curve=move.Geometry, Distance=脚オフセット, Plane=PlaneXY(0, 0, 0), Corners=1)
rectangle_2 = Rectangle(Plane=PlaneXY(0, 0, 0), XSize="-10 to 10", YSize="-10 to 10", Radius=0)  # -> Rectangle, Length
boundary = BoundarySurfaces(Edges=move.Geometry)
Z_2 = UnitZ(Factor="30")
debrep = DeconstructBrep(Brep=offset)  # -> Faces, Edges, Vertices
debrep_2 = DeconstructBrep(Brep=geo)  # -> Faces, Edges, Vertices
ln = Line(StartPoint=debrep.Vertices, EndPoint=debrep_2.Vertices)
geo_2 = Geometry(rectangle_2.Rectangle)
pt = Point(debrep_2.Vertices)
debrep_3 = DeconstructBrep(Brep=boundary)  # -> Faces, Edges, Vertices
orient = Orient(Geometry=geo_2, Source=PlaneXY(0, 0, 0), Target=pt)  # -> Geometry, Transform
extrude = ExtrudeLinear(Profile=orient.Geometry, OrientationP=pt, Axis=ln, OrientationA=debrep.Vertices)
item = ListItem(List=debrep_3.Edges, Index="2", Wrap=True)
item_2 = ListItem(List=debrep_3.Vertices, Index="3", Wrap=True)
mid = TK_MidPoint(C=item)  # -> P
# ---------- mid: Python ----------
import rhinoscriptsyntax as rs

if C!=None:
    P=rs.CurveMidPoint(C)
else:
    P=None
# ---------- end mid ----------
ln_2 = Line(StartPoint=mid, EndPoint=item_2)
yz = YZPlane(Origin=mid)
eval = EvaluateCurve(Curve=ln_2, Parameter=背もたれ支持材位置)  # -> Point, Tangent, Angle
mirror = Mirror(Geometry=eval.Point, Plane=yz)  # -> Geometry, Transform
Z_3 = UnitZ(Factor=1)
Y = UnitY(Factor="10")
pt_2 = Point([mirror.Geometry, eval.Point])
division = Division(A=基本幅, B=-2)
division_2 = Division(A=基本幅, B=2)
move_2 = Move(Geometry=pt_2, Motion=Y)  # -> Geometry, Transform
line = LineSDL(Start=pt_2, Direction=Z_3, Length=基本奥行き_2)  # -> graft(Line)
xz = XZPlane(Origin=mid)
dom = ConstructDomain(DomainStart=division, DomainEnd=division_2)
orient_2 = Orient(Geometry=rectangle_2.Rectangle, Source=PlaneXY(0, 0, 0), Target=move_2.Geometry)  # -> graft(Geometry), Transform
bang = ExplodeTree(Data=line)  # -> Branch0, Branch1
swp1 = Sweep1(Rail=line, Sections=orient_2.Geometry, Miter=1)
rectangle_3 = Rectangle(Plane=xz, XSize=dom, YSize="-250", Radius=0)  # -> Rectangle, Length
len = Length(Curve=bang.Branch0)
Z_4 = UnitZ(Factor=len)
cap = CapHoles(Brep=swp1)
cap_2 = CapHoles(Brep=extrude)
move_3 = Move(Geometry=rectangle_3.Rectangle, Motion=Z_4)  # -> Geometry, Transform
extr = Extrude(Base=boundary, Direction=Z_2)
Y_2 = UnitY(Factor=expr("x*-1", "30"))
boundary_2 = BoundarySurfaces(Edges=move_3.Geometry)
extr_2 = Extrude(Base=boundary_2, Direction=Y_2)
brep = Brep([extr, cap, cap_2, extr_2])
