# Grasshopper definition portugal_c.gh (Grasshopper 1.0.4)

基本幅 = Slider(8, range=4..8, expression="x*100")
基本幅_2 = Slider(6, range=4..6, expression="x*100")
number_slider = Slider(1, range=1..2, expression="x*50")
高さ = Slider(5, range=3..5, expression="x*100")
rectangle = Rectangle(Plane=PlaneXY(0, 0, 0), XSize=基本幅, YSize=基本幅_2, Radius=0)  # -> Rectangle, Length
Z = UnitZ(Factor=高さ)
dom = ConstructDomain(DomainStart="-30", DomainEnd="30")
geo = Geometry(graft(rectangle.Rectangle))
rectangle_2 = Rectangle(Plane=PlaneXY(0, 0, 0), XSize=dom, YSize=dom, Radius=0)  # -> Rectangle, Length
move = Move(Geometry=geo, Motion=Z)  # -> graft(Geometry), Transform
debrep = DeconstructBrep(Brep=geo)  # -> Faces, Edges, Vertices
debrep_2 = DeconstructBrep(Brep=move.Geometry)  # -> Faces, Edges, Vertices
orient = Orient(Geometry=rectangle_2.Rectangle, Source=PlaneXY(0, 0, 0), Target=debrep.Vertices)  # -> Geometry, Transform
ln = Line(StartPoint=debrep.Vertices, EndPoint=debrep_2.Vertices)
offset = OffsetCurve(Curve=move.Geometry, Distance="30", Plane=PlaneXY(0, 0, 0), Corners=1)
graft = GraftTree(Tree=ln, IncludeEmptyLists=True, IncludeNullItems=True)
graft_2 = GraftTree(Tree=orient.Geometry, IncludeEmptyLists=True, IncludeNullItems=True)
swp1 = Sweep1(Rail=graft, Sections=graft_2, Miter=1)
Z_2 = UnitZ(Factor=number_slider)
boundary = BoundarySurfaces(Edges=offset)
area = Area(Geometry=boundary)  # -> Area, Centroid
debrep_3 = DeconstructBrep(Brep=boundary)  # -> Faces, Edges, Vertices
item = ListItem(List=debrep_3.Edges, Index=0, Wrap=True)  # -> Item, Item1, Item2, Item3
line = Line(item.Item3)
end = EndPoints(Curve=line)  # -> Start, End
eval = EvaluateCurve(Curve=line, Parameter=Slider(5, range=3..5, expression="x*0.2"))  # -> Point, Tangent, Angle
ln_2 = Line(StartPoint=end.Start, EndPoint=eval.Point)
Z_3 = UnitZ(Factor=Slider(4, range=2..4, expression="x*100"))
ext = ExtendCurve(Curve=ln_2, Type=0, Start=number_slider, End="0")
Z_4 = UnitZ(Factor=Slider(4, range=2..4, expression="x*200"))
line_2 = Line(item.Item2)
move_2 = Move(Geometry=ext, Motion=Z_3)  # -> Geometry, Transform
X = UnitX(Factor=expr("x*-1", number_slider))
move_3 = Move(Geometry=line_2, Motion=Z_4)  # -> Geometry, Transform
loft = Loft(
    Curves=[ext, move_2.Geometry],
    Options={Adjust=False, Closed=False, LoftEnds=0, LoftSimp=0, LoftType=0, Rebuild=10, Refit=0.01})
yz = YZPlane(Origin=area.Centroid)
loft_2 = Loft(
    Curves=[line_2, move_3.Geometry],
    Options={Adjust=False, Closed=False, LoftEnds=0, LoftSimp=0, LoftType=0, Rebuild=10, Refit=0.01})
extr = Extrude(Base=loft, Direction=X)
Y = UnitY(Factor=number_slider)
cap = CapHoles(Brep=swp1)
mirror = Mirror(Geometry=extr, Plane=yz)  # -> Geometry, Transform
extr_2 = Extrude(Base=loft_2, Direction=Y)
extr_3 = Extrude(Base=boundary, Direction=Z_2)
brep = Brep(extr)
brep_2 = Brep([cap, extr_2, extr_3, mirror.Geometry, brep])
