# Grasshopper definition russia_c.gh (Grasshopper 1.0.4)

背もたれ形状_1 = Slider(4, range=1..4, expression="x*0.1")
背もたれ形状_1_2 = Slider(4, range=0..4, expression="x*0.1")
背もたれ支柱 = Slider(2, range=2..4)
座面高さ = Slider(5, range=3..5, expression="x*100")
基本幅 = Slider(8, range=3..8, expression="x*100")
基本幅_2 = Slider(5, range=3..5, expression="x*100")
subtraction = Subtraction(A=座面高さ, B="50")
rectangle = Rectangle(Plane=PlaneXY(0, 0, 0), XSize=基本幅, YSize=基本幅_2, Radius=0)  # -> Rectangle, Length
geo = Geometry(rectangle.Rectangle)
Z = UnitZ(Factor=subtraction)
move = Move(Geometry=geo, Motion=Z)  # -> Geometry, Transform
debrep = DeconstructBrep(Brep=geo)  # -> Faces, Edges, Vertices
debrep_2 = DeconstructBrep(Brep=move.Geometry)  # -> Faces, Edges, Vertices
dom = ConstructDomain(DomainStart="-15", DomainEnd="15")
join = JoinCurves(Curves=debrep_2.Edges, Preserve=False)
rectangle_2 = Rectangle(Plane=PlaneXY(0, 0, 0), XSize=dom, YSize=dom, Radius=0)  # -> Rectangle, Length
ln = Line(StartPoint=debrep.Vertices, EndPoint=debrep_2.Vertices)
geo_2 = Geometry(rectangle_2.Rectangle)
orient = Orient(Geometry=geo_2, Source=PlaneXY(0, 0, 0), Target=debrep.Vertices)  # -> Geometry, Transform
offset = OffsetCurve(Curve=join, Distance="50", Plane=PlaneXY(0, 0, 0), Corners=1)
graft = GraftTree(Tree=ln, IncludeEmptyLists=True, IncludeNullItems=True)
graft_2 = GraftTree(Tree=orient.Geometry, IncludeEmptyLists=True, IncludeNullItems=True)
boundary = BoundarySurfaces(Edges=offset, UseTasks=True)
Z_2 = UnitZ(Factor="50")
swp1 = Sweep1(Rail=graft, Sections=graft_2, Miter=1)
extr = Extrude(Base=boundary, Direction=Z_2)
debrep_3 = DeconstructBrep(Brep=extr)  # -> Faces, Edges, Vertices
item = ListItem(List=debrep_3.Edges, Index="7", Wrap=True)
mid = TK_MidPoint(C=item)  # -> P
# ---------- mid: Python ----------
import rhinoscriptsyntax as rs

if C!=None:
    P=rs.CurveMidPoint(C)
else:
    P=None
# ---------- end mid ----------
end = EndPoints(Curve=item)  # -> Start, End
ln_2 = Line(StartPoint=end.Start, EndPoint=mid)
eval = EvaluateCurve(Curve=ln_2, Parameter=背もたれ形状_1_2)  # -> Point, Tangent, Angle
eval_2 = EvaluateCurve(Curve=ln_2, Parameter=背もたれ形状_1)  # -> Point, Tangent, Angle
Z_3 = UnitZ(Factor="50")
Z_4 = UnitZ(Factor="400")
move_2 = Move(Geometry=eval.Point, Motion=Z_3)  # -> Geometry, Transform
move_3 = Move(Geometry=eval_2.Point, Motion=Z_4)  # -> Geometry, Transform
yz = YZPlane(Origin=mid)
intcrv = Interpolate(Vertices=[end.Start, move_2.Geometry, move_3.Geometry], Degree=3, Periodic=False, KnotStyle=1)  # -> Curve, Length, Domain
mirror = Mirror(Geometry=intcrv.Curve, Plane=yz)  # -> Geometry, Transform
flip = FlipCurve(Curve=mirror.Geometry)  # -> Curve, Flag
blendc = BlendCurve(CurveA=intcrv.Curve, CurveB=flip.Curve, BulgeA=1, BulgeB=1, Continuity=2)
join_2 = JoinCurves(Curves=[intcrv.Curve, blendc, mirror.Geometry], Preserve=False)
Y = UnitY(Factor="-30")
cap = CapHoles(Brep=swp1)
extr_2 = Extrude(Base=join_2, Direction=Y)
offset_2 = OffsetSurface(Surface=extr_2, Distance="-30", Retrim=True)
split = SplitBrep(Brep=offset_2, Cutter=extr)
item_2 = ListItem(List=split, Index="0", Wrap=True)
debrep_4 = DeconstructBrep(Brep=offset_2)  # -> Faces, Edges, Vertices
rulesrf = RuledSurface(CurveA=extr_2, CurveB=item_2)
item_3 = ListItem(List=debrep_4.Edges, Index="3", Wrap=True)
explode = Explode(Curve=item_3, Recursive=True)  # -> Segments, Vertices
item_4 = ListItem(List=explode.Segments, Index=0, Wrap=True)  # -> Item, Item1, Item2
crv = Curve(item_4.Item)
crv_2 = Curve(item_4.Item2)
crvprox = CurveProximity(CurveA=crv, CurveB=crv_2)  # -> PointA, PointB, Distance
ln_3 = Line(StartPoint=crvprox.PointA, EndPoint=crvprox.PointB)
mid_2 = TK_MidPoint(C=ln_3)  # -> P; same code as mid
pt = Point(mid)
orient_2 = Orient(Geometry=ln_3, Source=mid_2, Target=pt)  # -> Geometry, Transform
divide = DivideCurve(Curve=orient_2.Geometry, Count=背もたれ支柱, Kinks=False)  # -> Points, Tangents, Parameters
lng = ListLength(List=divide.Points)
subtraction_2 = Subtraction(A=lng, B=2)
dom_2 = ConstructDomain(DomainStart="1", DomainEnd=subtraction_2)
subset = SubList(List=divide.Points, Domain=dom_2, Wrap=True)  # -> graft(List), Index
Z_5 = UnitZ(Factor=1)
rectangle_3 = Rectangle(Plane=PlaneXY(0, 0, 0), XSize="-10 to 10", YSize="-20", Radius=0)  # -> Rectangle, Length
line = LineSDL(Start=subset.List, Direction=Z_5, Length="10000")  # -> graft(Line)
clx = CurveLine(Curve=item_3, Line=line)  # -> Points, Params, Count
geo_3 = Geometry(rectangle_3.Rectangle)
ln_4 = Line(StartPoint=subset.List, EndPoint=clx.Points)
orient_3 = Orient(Geometry=geo_3, Source=PlaneXY(0, 0, 0), Target=subset.List)  # -> Geometry, Transform
swp1_2 = Sweep1(Rail=ln_4, Sections=orient_3.Geometry, Miter=1)
join_3 = BrepJoin(Breps=[extr_2, rulesrf, item_2])  # -> Breps, Closed
brep = Brep(swp1_2)
brep_2 = Brep([cap, extr, join_3.Breps, brep])
