# Grasshopper definition spain_a.gh (Grasshopper 0.9.76)
# plug-ins: Python Interpreter, FilletBox

背もたれ丸角半径 = Slider(3, range=1..3, expression="x*30")
背もたれ下端高さ = Slider(5, range=4..5, expression="x*100")
背もたれ高さ = Slider(2, range=2..4, expression="x*50")
number_slider = Slider(5, range=3..5, expression="x*0.2")
number_slider_2 = Slider(4, range=1..4, expression="x*50")
基本幅 = Slider(5, range=2..5, expression="x*200")
座面高 = Slider(3, range=3..5, expression="x*100")
rectangle = Rectangle(Plane=PlaneXY(0, 0, 0), XSize=基本幅, YSize="500", Radius=0)  # -> Rectangle, Length
subtraction = Subtraction(A=座面高, B=number_slider_2)
offset = Offset(Curve=rectangle.Rectangle, Distance="35", Plane=PlaneXY(0, 0, 0), Corners=1)
Z = UnitZ(Factor=subtraction)
crv = Curve(offset)
move = Move(Geometry=rectangle.Rectangle, Motion=Z)  # -> Geometry, Transform
range = Range(Domain=Domain(0, 1), Steps=10)
crv_2 = Curve(rectangle.Rectangle)
move_2 = Move(Geometry=crv, Motion=Z)  # -> Geometry, Transform
debrep = DeconstructBrep(Brep=move.Geometry)  # -> Faces, Edges, Vertices
debrep_2 = DeconstructBrep(Brep=crv_2)  # -> Faces, Edges, Vertices
graph = GraphMapper(range, x0=0, x1=1, y0=0, y1=1, container_name="Sine", Equation_px=[0, 0.4999425113], Equation_py=[0, 0.1283476353])
boundary = BoundarySurfaces(Edges=move_2.Geometry)
Z_2 = UnitZ(Factor=number_slider_2)
ln = Line(StartPoint=debrep.Vertices, EndPoint=debrep_2.Vertices)
extr = Extrude(Base=boundary, Direction=Z_2)
dup = DuplicateData(Data=graph, Number="4", Order=True)
divide = DivideCurve(Curve=ln, Count=10, Kinks=False)  # -> Points, Tangents, Parameters
box = Box(extr)
partition = PartitionList(List=dup, Size=11)
pdecon = Deconstruct(Point=divide.Points)  # -> XComponent, YComponent, ZComponent
multiplication = Multiplication(A=pdecon.XComponent, B=partition)
multiplication_2 = Multiplication(A=pdecon.XComponent, B=partition)
debrep_3 = DeconstructBrep(Brep=rectangle.Rectangle)  # -> Faces, Edges, Vertices
pt = ConstructPoint(XCoordinate=multiplication, YCoordinate=multiplication_2, ZCoordinate=pdecon.ZComponent)
背もたれ幅 = Slider(5, range=2..5, expression="x*50")
item = ListItem(List=debrep_3.Vertices, Index=0, Wrap=True)  # -> Item, Item1, Item2, Item3
intcrv = Interpolate(Vertices=pt, Degree=3, Periodic=False, KnotStyle=1)  # -> Curve, Length, Domain
multiplication_3 = Multiplication(A=基本幅, B=0.4)
pt_2 = Point(item.Item1)
pt_3 = Point(item.Item2)
reb = RebuildCurve(Curve=intcrv.Curve, Count=5, Tangents=False)
multiplication_4 = Multiplication(A=multiplication_3, B=-1)
item_2 = ListItem(List=debrep_2.Vertices, Index=0, Wrap=True)  # -> Item, Item1, Item2, Item3
ln_2 = Line(StartPoint=pt_2, EndPoint=pt_3)
bang = ExplodeTree(Data=reb)  # -> _0000, _0001, _0002, _0003
multiplication_5 = Multiplication(A=背もたれ高さ, B=2)
mid = TK_MidPoint(C=ln_2)  # -> P
# ---------- mid: Python ----------
import rhinoscriptsyntax as rs

if C!=None:
    P=rs.CurveMidPoint(C)
else:
    P=None
# ---------- end mid ----------
dom = ConstructDomain(DomainStart=multiplication_4, DomainEnd=multiplication_3)
pt_4 = Point(Point(0, 0, 0))
pt_5 = Point([item_2.Item1, item_2.Item2, item_2.Item3])
xz = XZPlane(Origin=mid)
pipe = Pipe(Curve=bang._0002, Radius="15", Caps=1)
vec2pt = Vector2Pt(PointA=pt_4, PointB=pt_5, Unitize=False)  # -> Vector, Length
rectangle_2 = Rectangle(Plane=xz, XSize=dom, YSize=multiplication_5, Radius=背もたれ丸角半径)  # -> Rectangle, Length
Z_3 = UnitZ(Factor=背もたれ下端高さ)
move_3 = Move(Geometry=pipe, Motion=vec2pt.Vector)  # -> Geometry, Transform
move_4 = Move(Geometry=rectangle_2.Rectangle, Motion=Z_3)  # -> Geometry, Transform
item_3 = ListItem(List=move_3.Geometry, Index=0, Wrap=True)  # -> Item, Item1, Item2
num = Number(expr("rad(x)", "270"))
num_2 = Number(expr("rad(x)", "180"))
num_3 = Number(expr("rad(x)", "90"))
Y = UnitY(Factor=expr("x*-1", "100"))
boundary_2 = BoundarySurfaces(Edges=move_4.Geometry)
extr_2 = Extrude(Base=boundary_2, Direction=Y)
boxfillet = BoxFillet(Box=box, Radius=Slider(44, range=0..100), currentstate_of_FilletBox_menu=0)
rotate = Rotate(Geometry=item_3.Item, Angle=num, Plane=item_2.Item1)  # -> Geometry, Transform
rotate_2 = Rotate(Geometry=item_3.Item1, Angle=num_2, Plane=item_2.Item2)  # -> Geometry, Transform
rotate_3 = Rotate(Geometry=item_3.Item2, Angle=num_3, Plane=item_2.Item3)  # -> Geometry, Transform
geo = Geometry(pipe)
debrep_4 = DeconstructBrep(Brep=extr_2)  # -> Faces, Edges, Vertices
item_4 = ListItem(List=debrep_4.Edges, Index=0, Wrap=True)  # -> Item, Item1
addition = Addition(A=Z, B=Z_2)
crv_3 = Curve(rectangle.Rectangle)
explode = Explode(Curve=item_4.Item1, Recursive=True)  # -> Segments, Vertices
move_5 = Move(Geometry=crv_3, Motion=addition)  # -> Geometry, Transform
item_5 = ListItem(List=explode.Vertices, Index=0, Wrap=True)  # -> Item, Item1, Item2, Item3, Item4, Item5, Item6
debrep_5 = DeconstructBrep(Brep=move_5.Geometry)  # -> Faces, Edges, Vertices
pt_6 = Point(item_5.Item1)
pt_7 = Point(item_5.Item6)
item_6 = ListItem(List=debrep_5.Vertices, Index=0, Wrap=True)
item_7 = ListItem(List=debrep_5.Edges, Index=0, Wrap=True)  # -> Item, Item1, Item2, Item3
pdecon_2 = Deconstruct(Point=item_6)  # -> XComponent, YComponent, ZComponent
pdecon_3 = Deconstruct(Point=pt_7)  # -> XComponent, YComponent, ZComponent
line = Line(item_7.Item3)
line_2 = Line(item_7.Item1)
subtraction_2 = Subtraction(A=pdecon_3.ZComponent, B=pdecon_2.ZComponent)
subtraction_3 = Subtraction(A=1, B=number_slider)
Z_4 = UnitZ(Factor=subtraction_2)
eval = EvaluateCurve(Curve=line_2, Parameter=number_slider)  # -> Point, Tangent, Angle
eval_2 = EvaluateCurve(Curve=line, Parameter=subtraction_3)  # -> Point, Tangent, Angle
move_6 = Move(Geometry=eval.Point, Motion=Z_4)  # -> Geometry, Transform
move_7 = Move(Geometry=eval_2.Point, Motion=Z_4)  # -> Geometry, Transform
ln_3 = Line(StartPoint=pt_7, EndPoint=move_7.Geometry)
ln_4 = Line(StartPoint=pt_6, EndPoint=move_6.Geometry)
end = EndPoints(Curve=[ln_4, ln_3])  # -> Start, End
Z_5 = UnitZ(Factor=-1)
pt_8 = Point(end.End)
line_3 = LineSDL(Start=pt_8, Direction=Z_5, Length=subtraction_2)
pipe_2 = Pipe(Curve=[line_3, ln_3, ln_4], Radius="15", Caps=2)
