# Grasshopper definition spain_b.gh (Grasshopper 0.9.76)

背もたれ上端高さ = Slider(5, range=1..5, expression="x*100")
背もたれ上端高さ_2 = Slider(2, range=0..2, expression="x*50")
座面オフセット = Slider(3, range=3..5, expression="x*10")
基本奥行 = Slider(3, range=3..6, expression="x*100")
座面高さ = Slider(5, range=3..5, expression="x*100")
脚径 = Slider(1, range=1..3, expression="x*10")
基本幅 = Slider(3, range=3..6, expression="x*100")
rectangle = Rectangle(Plane=PlaneXY(0, 0, 0), XSize=基本幅, YSize=基本奥行, Radius=0)  # -> Rectangle, Length
debrep = DeconstructBrep(Brep=rectangle.Rectangle)  # -> Faces, Edges, Vertices
graft = GraftTree(Tree=debrep.Vertices, IncludeEmptyLists=True, IncludeNullItems=True)  # -> simplify(Tree)
cir = Circle(Plane=graft, Radius=脚径)
Z = UnitZ(Factor=座面高さ)
move = Move(Geometry=rectangle.Rectangle, Motion=Z)  # -> Geometry, Transform
Z_2 = UnitZ(Factor=座面高さ)
offset = Offset(Curve=move.Geometry, Distance=座面オフセット, Plane=PlaneXY(0, 0, 0), Corners=1)
extr = Extrude(Base=cir, Direction=Z_2)
boundary = BoundarySurfaces(Edges=offset)
Z_3 = UnitZ(Factor="30")
cap = CapHoles(Brep=extr)
extr_2 = Extrude(Base=boundary, Direction=Z_3)
debrep_2 = DeconstructBrep(Brep=extr_2)  # -> Faces, Edges, Vertices
item = ListItem(List=debrep_2.Edges, Index="13", Wrap=True)
Z_4 = UnitZ(Factor=背もたれ上端高さ)
move_2 = Move(Geometry=item, Motion=Z_4)  # -> Geometry, Transform
number_slider = Slider(10, range=0..10)
end = EndPoints(Curve=move_2.Geometry)  # -> Start, End
end_2 = EndPoints(Curve=item)  # -> Start, End
dom = ConstructDomain(DomainStart=0, DomainEnd=1)
range = Range(Domain=dom, Steps=number_slider)
ln = Line(StartPoint=end.Start, EndPoint=end_2.Start)
addition = Addition(A=基本奥行, B=座面オフセット)
graph = GraphMapper(range, x0=0, x1=1, y0=0, y1=1, container_name="Sine", Equation_px=[0, 1], Equation_py=[1, 0])
divide = DivideCurve(Curve=ln, Count=number_slider, Kinks=False)  # -> Points, Tangents, Parameters
addition_2 = Addition(A=addition, B=背もたれ上端高さ_2)
pdecon = Deconstruct(Point=divide.Points)  # -> XComponent, YComponent, ZComponent
dom_2 = ConstructDomain(DomainStart=addition, DomainEnd=addition_2)
remap = RemapNumbers(Value=graph, Source=Domain(0, 1), Target=dom_2)  # -> Mapped, Clipped
panel = Panel(graph)
pt = ConstructPoint(XCoordinate=pdecon.XComponent, YCoordinate=remap.Mapped, ZCoordinate=pdecon.ZComponent)
intcrv = Interpolate(Vertices=pt, Degree=3, Periodic=False, KnotStyle=1)  # -> Curve, Length, Domain
panel_2 = Panel(remap.Mapped)
reb = RebuildCurve(Curve=intcrv.Curve, Count=10, Tangents=False)
Y = UnitY(Factor=expr("x*-1", "30"))
swp1 = Sweep1(Rail=item, Sections=reb, Miter=1)
extr_3 = Extrude(Base=swp1, Direction=Y)
