# Grasshopper definition voxelizing.gh (Grasshopper 0.9.76)
# plug-ins: GH_CPython

背もたれ上端高さ = Slider(5, range=5..7, expression="x*100")
肘掛け幅 = Slider(1, range=1..3, expression="x*40")
肘掛け角丸 = Slider(0, range=0..2, expression="x*60")
背もたれ角度 = Slider(0, range=0..2, expression="x*-10")
基本奥行き = Slider(4, range=4..6, expression="x*100")
肘掛け高さ = Slider(4, range=4..6, expression="x*100")
座面高さ = Slider(3, range=3..4, expression="x*100")
基本幅 = Slider(5, range=4..6, expression="x*100")
yz = YZPlane(Origin=Point(0, 0, 0))
X = UnitX(Factor=基本幅)
rectangle = Rectangle(Plane=yz, XSize=基本奥行き, YSize=肘掛け高さ, Radius=肘掛け角丸)  # -> Rectangle, Length
move = Move(Geometry=rectangle.Rectangle, Motion=X)  # -> Geometry, Transform
yz_2 = YZPlane(Origin=Point(0, 0, 0))
crv = Curve([rectangle.Rectangle, move.Geometry])
offset = Offset(Curve=crv, Distance="-30", Plane=yz_2, Corners=1)
graft = GraftTree(Tree=crv, IncludeEmptyLists=True, IncludeNullItems=True)
graft_2 = GraftTree(Tree=offset, IncludeEmptyLists=True, IncludeNullItems=True)
rulesrf = RuledSurface(CurveA=graft, CurveB=graft_2)
X_2 = UnitX(Factor=肘掛け幅)
extr = Extrude(Base=rulesrf, Direction=X_2)
bbox = BoundingBox(Content=extr, Plane=PlaneXY(0, 0, 0))  # -> Box, Box_2
bang = ExplodeTree(Data=bbox.Box)  # -> _0000, _0100
debrep = DeconstructBrep(Brep=bang._0000)  # -> Faces, Edges, Vertices
debrep_2 = DeconstructBrep(Brep=bang._0100)  # -> Faces, Edges, Vertices
devec = DeconstructVector(Vector=debrep.Vertices)  # -> XComponent, YComponent, ZComponent
devec_2 = DeconstructVector(Vector=debrep_2.Vertices)  # -> XComponent, YComponent, ZComponent
sort = SortList(Keys=devec.XComponent)  # -> Keys, ValuesA
sort_2 = SortList(Keys=devec_2.XComponent)  # -> Keys, ValuesA
rev = ReverseList(List=sort.Keys)
item = ListItem(List=rev, Index=0, Wrap=True)
item_2 = ListItem(List=sort_2.Keys, Index=0, Wrap=True)
pt = ConstructPoint(XCoordinate=item, YCoordinate=0, ZCoordinate=0)
subtraction = Subtraction(A=item_2, B=item)
rectangle_2 = Rectangle(Plane=pt, XSize=subtraction, YSize=基本奥行き, Radius=0)  # -> Rectangle, Length
Z = UnitZ(Factor=座面高さ)
move_2 = Move(Geometry=rectangle_2.Rectangle, Motion=Z)  # -> Geometry, Transform
Z_2 = UnitZ(Factor="-30")
boundary = BoundarySurfaces(Edges=move_2.Geometry)
extr_2 = Extrude(Base=boundary, Direction=Z_2)
debrep_3 = DeconstructBrep(Brep=extr_2)  # -> Faces, Edges, Vertices
item_3 = ListItem(List=debrep_3.Edges, Index="9", Wrap=True)
Z_3 = UnitZ(Factor=背もたれ上端高さ)
crv_2 = Curve(item_3)
c_script = CSharpScript(folder="C:\ParametricImages\", makeimages=Button())  # -> out, A; inputs folder: String, makeimages: Boolean
# ---------- c_script: C# ----------
    if (!makeimages)
      return;

    if (_running)
      return;

    if (!System.IO.Directory.Exists(folder))
      System.IO.Directory.CreateDirectory(folder);

    _folder = folder;
    _run = true;
    GrasshopperDocument.SolutionEnd += OnSolutionEnd;
# ---------- c_script: C# additional code ----------
  private bool _run = false;
  private bool _running = false;
  private string _folder;

  private void OnSolutionEnd(object sender, GH_SolutionEventArgs e)
  {
    // Unregister the event, we don't want to get called again.
    e.Document.SolutionEnd -= OnSolutionEnd;

    // If we're not supposed to run, abort now.
    if (!_run)
      return;

    // If we're already running, abort now.
    if (_running)
      return;

    // Reset run and running states.
    _run = false;
    _running = true;

    try
    {
      // Find all sliders.
      List<Grasshopper.Kernel.Special.GH_NumberSlider> sliders = new List<Grasshopper.Kernel.Special.GH_NumberSlider>();
      foreach (IGH_DocumentObject docObject in GrasshopperDocument.Objects)
      {
        Grasshopper.Kernel.Special.GH_NumberSlider slider = docObject as Grasshopper.Kernel.Special.GH_NumberSlider;
        if (slider == null)
          continue;
        sliders.Add(slider);
      }
      if (sliders.Count == 0)
      {
        System.Windows.Forms.MessageBox.Show("No sliders could be found", "<harsh buzzing sound>", MessageBoxButtons.OK);
        return;
      }

      // Set all sliders back to zero.
      //GH_Document.EnableSolutions = false;
      foreach (Grasshopper.Kernel.Special.GH_NumberSlider slider in sliders)
        slider.TickValue = 0;

      // Start a giant loop in which we'll permutate our way across all slider layouts.
      int imageNumber = 0;
      while (true)
      {
        int idx = 0;
        if (!MoveToNextPermutation(ref idx, sliders))
          break;

        // We've just got a new valid permutation. Solve the new solution.
        e.Document.NewSolution(false);
        Rhino.RhinoDoc.ActiveDoc.Views.Redraw();

        Rhino.Display.RhinoView view = RhinoDocument.Views.Find("Perspective", false);
        if (view == null)
          break;

        string fileName = string.Format("{0}\\{1}.png", _folder, imageNumber);
        imageNumber++;

        Bitmap image = view.CaptureToBitmap();
        if (image == null)
          continue;

        image.Save(fileName);
        image.Dispose();
        image = null;
      }
    }
    catch(Exception ex)
    {
      // Ehm, exception, best swallow it here lest it totally crashes everything.
    }
    finally
    {
      // Always make sure that _running is switched off.
      _running = false;
    }
  }

  private bool MoveToNextPermutation(ref int index, List<Grasshopper.Kernel.Special.GH_NumberSlider> sliders)
  {
    if (index >= sliders.Count)
      return false;

    Grasshopper.Kernel.Special.GH_NumberSlider slider = sliders[index];
    if (slider.TickValue < slider.TickCount)
    {
      // Increment the slider.
      slider.TickValue++;
      return true;
    }
    else
    {
      // The current slider is already at the maximum value. Reset it back to zero.
      slider.TickValue = 0;

      // Move on to the next slider.
      index++;

      // If we've run out of sliders to modify, we're done permutatin'
      if (index >= sliders.Count)
        return false;

      return MoveToNextPermutation(ref index, sliders);
    }
  }
# ---------- end c_script ----------
move_3 = Move(Geometry=crv_2, Motion=Z_3)  # -> Geometry, Transform
end = EndPoints(Curve=crv_2)  # -> Start, End
loft = Loft(
    Curves=[crv_2, move_3.Geometry],
    Options={Adjust=False, Closed=False, LoftEnds=0, LoftSimp=0, LoftType=0, Rebuild=10, Refit=0.01})
Y = UnitY(Factor="-30")
yz_3 = YZPlane(Origin=end.End)
num = Number(expr("rad(x)", 背もたれ角度))
extr_3 = Extrude(Base=loft, Direction=Y)
rotate = Rotate(Geometry=extr_3, Angle=num, Plane=yz_3)  # -> Geometry, Transform
brep = Brep([extr, extr_2, rotate.Geometry])
cluster = Cluster(
    geometry=brep,
    path="C:\Users\RFA4\Desktop\Sample",
    size=Slider(1000, range=0..1500),
    file="chair2.mat",
    resolution=Slider(30, range=0..100),
    save=Button())

range = Range(Domain=Slider(1000, range=0..1500), Steps=expr("x-1", simplify(Slider(30, range=0..100))))
pt_2 = ConstructPoint(XCoordinate=range, YCoordinate=0, ZCoordinate=0)
gh_cpython = GH_CPython(path="C:\Users\RFA4\Desktop\Sample", file="chair2.mat", load=Button())  # -> output, a; inputs path: list, file: list, load: list
#   port path: [required] - [type = int] - [default = None] Descripe your input here * bullet point. * bullet point
#   port output: indicate your output description here. refers to a new line.
# ---------- gh_cpython: Python ----------
import scipy.io
import Grasshopper as gh

mat = scipy.io.loadmat(path + "\\" + file)

#output_ = mat["instance"][0][0];



output_ = mat["instance"].tolist()

a = mat["instance"]
# ---------- end gh_cpython ----------
graft_3 = GraftTree(Tree=pt_2, IncludeEmptyLists=True, IncludeNullItems=True)
Y_2 = UnitY(Factor=range)
move_4 = Move(Geometry=graft_3, Motion=Y_2)  # -> Geometry, Transform
c_script_2 = CSharpScript(x=gh_cpython.output, n=Slider(30, range=0..100))  # -> out, A; inputs x: list of Int32, n: Int32
# ---------- c_script_2: C# ----------
    DataTree<int> tree = new DataTree<int>();

    int count = 0;
    for(int i = 0; i < n; i++){
      for(int s = 0; s < n; s++){
        for(int t = 0; t < n; t++){
          GH_Path path = new GH_Path(i, s,t);
          tree.Add(x[count], path);

          count++;
        }
      }
    }

    A = tree;
# ---------- end c_script_2 ----------
graft_4 = GraftTree(Tree=move_4.Geometry, IncludeEmptyLists=True, IncludeNullItems=True)
Z_4 = UnitZ(Factor=range)
item_4 = ListItem(List=range, Index=1, Wrap=True)
move_5 = Move(Geometry=graft_4, Motion=Z_4)  # -> simplify(Geometry), Transform
division = Division(A=item_4, B=2)
graft_5 = GraftTree(Tree=move_5.Geometry, IncludeEmptyLists=True, IncludeNullItems=True)  # -> simplify(Tree)
item_5 = ListItem(List=flatten(graft_5), Index=Slider(24, range=0..1000), Wrap=True)
cull = CullPattern(List=graft_5, CullPattern=c_script_2.A)
box = CenterBox(Base=cull, X=division, Y=division, Z=division)
preview = CustomPreview(Geometry=box, Material=ColourSwatch(SwatchColor=RGB(102, 168, 255)))

gh_cpython_2 = GH_CPython(path="C:\Users\RFA4\Desktop\Sample", file="test2.mat", save=Button())  # -> output; inputs path: list, file: list, save: list
#   port output: indicate your output description here. refers to a new line.
# ---------- gh_cpython_2: Python ----------
import numpy as np
import scipy.io

data = np.arange(10)

if(save):
    scipy.io.savemat(path + "\\" + file, {'name':data})

output_ = data
# ---------- end gh_cpython_2 ----------
panel = Panel(gh_cpython_2)

gh_cpython_3 = GH_CPython()  # -> output
#   port output: indicate your output description here. refers to a new line.
# ---------- gh_cpython_3: Python ----------
import numpy as np

arr = np.empty((0,3,3),int)

arr = np.append(arr, np.array([[[1, 2, 3],[1, 2, 3],[1, 2, 3]]]), axis=0)
arr = np.append(arr, np.array([[[4, 5, 6],[4, 5, 6],[4, 5, 6]]]), axis=0)
arr = np.append(arr, np.array([[[7, 8, 9],[7, 8, 9],[7, 8, 9]]]), axis=0)

output_ = arr
# ---------- end gh_cpython_3 ----------
panel_2 = Panel(gh_cpython_3)

# ==== cluster Cluster
resolution = ClusterInput()
size = ClusterInput()
geometry = ClusterInput()
int = Integer(resolution)
path = ClusterInput()
file = ClusterInput()
save = ClusterInput()
int_2 = Integer(int)

num = Number(size)
geo = Geometry(flatten(geometry))
range = Range(Domain=num, Steps=expr("x-1", simplify(int)))
bbox = BoundingBox(Content=geo, Plane=PlaneXY(0, 0, 0), UnionBox=True)  # -> Box, Box_2
area = Area(Geometry=bbox.Box)  # -> Area, Centroid
pt = ConstructPoint(XCoordinate=range, YCoordinate=0, ZCoordinate=0)  # -> simplify(graft(Point))
pt_2 = ConstructPoint(XCoordinate=num, YCoordinate=num, ZCoordinate=0)
pt_3 = ConstructPoint(XCoordinate=num, YCoordinate=num, ZCoordinate=num)
pt_4 = ConstructPoint(XCoordinate=0, YCoordinate=0, ZCoordinate=0)
pdecon = Deconstruct(Point=area.Centroid)  # -> XComponent, YComponent, ZComponent
division = Division(A=pt_2, B=2)
box = Box2Pt(PointA=pt_4, PointB=pt_3, Plane=PlaneXY(0, 0, 0))
Z = UnitZ(Factor=range)
pt_5 = ConstructPoint(XCoordinate=pdecon.XComponent, YCoordinate=pdecon.YComponent, ZCoordinate=0)
item = ListItem(List=range, Index=1, Wrap=True)
orient = Orient(Geometry=geo, Source=pt_5, Target=division)  # -> Geometry, Transform
division_2 = Division(A=item, B=2)
mesh = Mesh(orient.Geometry)
mjoin = MeshJoin(Meshes=mesh)

Y = UnitY(Factor=range)
move = Move(Geometry=pt, Motion=Y)  # -> graft(Geometry), Transform

move_2 = Move(Geometry=move.Geometry, Motion=Z)  # -> Geometry, Transform
flatten = FlattenTree(Tree=move_2.Geometry, Path="{0}")
pull = PullPoint(Point=flatten, Geometry=mjoin, ClosestOnly=True)  # -> ClosestPoint, Distance
smaller = SmallerThan(FirstNumber=pull.Distance, SecondNumber=division_2)  # -> SmallerThan, OrEqualTo
cull = CullPattern(List=flatten, CullPattern=smaller.SmallerThan)

meshcp = MeshClosestPoint(Point=flatten, Mesh=mjoin)  # -> Point, Index, Parameter
vec2pt = Vector2Pt(PointA=flatten, PointB=meshcp.Point, Unitize=False)  # -> Vector, Length
meval = MeshEval(Mesh=mjoin, Parameter=meshcp.Parameter)  # -> Point, Normal, Colour
unit = UnitVector(Vector=vec2pt.Vector)
unit_2 = UnitVector(Vector=meval.Normal)
dprod = DotProduct(VectorA=unit_2, VectorB=unit, Unitize=False)
larger = LargerThan(FirstNumber=dprod, SecondNumber=Slider(0.01, range=0..1))  # -> LargerThan, OrEqualTo

or = GateOr(A=smaller.SmallerThan, B=larger.OrEqualTo)
cull_2 = CullPattern(List=flatten, CullPattern=or)

num_2 = Number(int)
int_3 = Integer(or)
gh_cpython = GH_CPython(path=path, file=file, data=int_3, n=int_2, save=save)  # -> output; inputs path: list, file: list, data: list, n: list, save: list
#   port output: indicate your output description here. refers to a new line.
# ---------- gh_cpython: Python ----------
import numpy as np
import scipy.io

arr = np.empty((0,n,n), int)

count = 0
for i in range(n):
    arrT = np.empty((0,n), int)
    for t in range(n):
        arrS = np.empty((0), int)
        for s in range(n):
            arrS = np.append(arrS, np.array( data[count] ))
            count += 1
        arrT = np.append(arrT,np.array([arrS]), axis=0)
    arr = np.append(arr, np.array([arrT]), axis=0)

output_ = arr

if(save):
    scipy.io.savemat(path + "\\" + file, {'instance':arr})
# ---------- end gh_cpython ----------

panel = Panel(num_2)
output = ClusterOutput(cull_2)
panel_2 = Panel(int_3)
